# Grasshopper definition 1.JD_SwissALTI3D.gh (Grasshopper 1.0.7)
# plug-ins: EleFront

panel = Panel("C:\Users\Admin\Documents\Github\EarlyStageDesign\JD\Turtmannsee\Terrain_SwissALTI3D\SWISSALTI3D_2_XYZ_CHLV95_LN02_2619_1111.xyz")
panel_2 = Panel("C:\Users\Admin\Documents\Github\EarlyStageDesign\JD\Turtmannsee\Terrain_SwissALTI3D\SWISSALTI3D_2_XYZ_CHLV95_LN02_2618_1111.xyz")
panel_3 = Panel("C:\Users\Admin\Documents\Github\EarlyStageDesign\JD\Turtmannsee\Terrain_SwissALTI3D\SWISSALTI3D_2_XYZ_CHLV95_LN02_2619_1112.xyz")
panel_4 = Panel("C:\Users\Admin\Documents\Github\EarlyStageDesign\JD\Turtmannsee\Terrain_SwissALTI3D\SWISSALTI3D_2_XYZ_CHLV95_LN02_2618_1112.xyz")
panel_5 = Panel("C:\Users\Admin\Documents\Github\EarlyStageDesign\JD\Turtmannsee\Terrain_SwissALTI3D\SWISSALTI3D_2_XYZ_CHLV95_LN02_2618_1113.xyz")
panel_6 = Panel("C:\Users\Admin\Documents\Github\EarlyStageDesign\JD\Turtmannsee\Terrain_SwissALTI3D\SWISSALTI3D_2_XYZ_CHLV95_LN02_2619_1113.xyz")
panel_7 = Panel("C:\Users\Admin\Documents\Github\EarlyStageDesign\JD\Turtmannsee\Terrain_SwissALTI3D\SWISSALTI3D_2_XYZ_CHLV95_LN02_2618_1114.xyz")
panel_8 = Panel("C:\Users\Admin\Documents\Github\EarlyStageDesign\JD\Turtmannsee\Terrain_SwissALTI3D\SWISSALTI3D_2_XYZ_CHLV95_LN02_2619_1114.xyz")
panel_9 = Panel("C:\Users\Admin\Documents\Github\EarlyStageDesign\JD\Turtmannsee\Terrain_SwissALTI3D\SWISSALTI3D_2_XYZ_CHLV95_LN02_2620_1111.xyz")
panel_10 = Panel("C:\Users\Admin\Documents\Github\EarlyStageDesign\JD\Turtmannsee\Terrain_SwissALTI3D\SWISSALTI3D_2_XYZ_CHLV95_LN02_2620_1112.xyz")
panel_11 = Panel("C:\Users\Admin\Documents\Github\EarlyStageDesign\JD\Turtmannsee\Terrain_SwissALTI3D\SWISSALTI3D_2_XYZ_CHLV95_LN02_2620_1113.xyz")
panel_12 = Panel("C:\Users\Admin\Documents\Github\EarlyStageDesign\JD\Turtmannsee\Terrain_SwissALTI3D\SWISSALTI3D_2_XYZ_CHLV95_LN02_2620_1114.xyz")
# It only works with
# rectangular shapes!
panel_13 = Panel(" ")
coords = ImportCoordinates(
    File=[panel, panel_2, panel_4, panel_3, panel_5, panel_7, panel_6, panel_8, panel_9, panel_10, panel_11, panel_12],
    Separator=panel_13,
    XIndex=0,
    YIndex=1,
    ZIndex=2)
cull_i = CullIndex(List=coords, Indices=Slider(0, range=0..100), Wrap=True)
dam = DataDam(DataA=cull_i, BufferDelay=10000000, BufferMode=0)
lng = ListLength(List=dam)
pt = Point(flatten(dam))
expression = Expression(x=lng, Expression="x^½")  # -> simplify(R)
sort_pt = SortPoints(Points=pt)  # -> Points, Indices
branch = TreeBranch(Tree=expression, Path="{0}", MaintainPaths=True)
side_size = Panel(branch)
# Adjust this amount here!
amount_of_itens_u_direction = Panel("3")
expression_2 = Expression(x=amount_of_itens_u_direction, side=side_size, Expression="side*x")  # -> simplify(U)
srfgrid = SurfaceFromPoints(Points=sort_pt.Points, UCount=expression_2, Interpolate=False)
# Bake! (activate buttom)
# then save rhino file
attributes = DefineObjectAttributes(Layer="Terrain_brep")
bake = BakeObjects(Geometry=srfgrid, Attributes=attributes, Bake=False)
