# Grasshopper definition JD_Beta_close origin_design.gh (Grasshopper 1.0.7)
# Copyright: © 2017-2018 Pierre Cuvilliers, Caitlin Mueller, Massachusetts Institute of Technology
# plug-ins: Telepathy, MetaHopper, UiPlus, Heteroptera, Pufferfish, MeshEdit Components, Hops, Heron, EleFront, RhinoCodePluginGH, TT Toolbox

# Water fields
panel = Panel("Resources\Translations\Water_en.txt")
# Arch Dam fields
panel_2 = Panel("Resources\Translations\ArchDam_en.txt")

panel_3 = Panel("""Concrete gravity dam
Arch dam
Embankment dam""")
# Dam configuration
# Dashboard structure
panel_4 = Panel("Type of Dam (m)")

# ----
# In conda cmd prompt:
# 
# conda activate C:\Users\cna\.conda\envs\rhinoremote
# 
# pip install <package> - for any missing package check the ouput to the right
# 
# For PIL -> pip install pillow
panel_5 = Panel("C:\Users\cna\Anaconda3\envs\rhinoremote")
panel_6 = Panel("""PIL
openpyxl""")
# Requirements hops scripts
panel_7 = Panel("Modules\Gravity.gh")
# Requirements plugins
# Python remote
panel_8 = Panel("""UI+
Metahopper""")

# ---- group: INFO
# _________________________________
# 
# This file is done based on the rhino file:
# _________________________________
# "C:\Users\Admin\Gruner AG\BSBE [ORG] - Digitale Anwendungen ESD\04_Projekte\2023\CH_VS_Barrage Les Toules_SensitivityAnalysis_JD\Model\231708_Le toules-WSCH00320.3dm"
# Images folder - saved where the gh file is
# Image size settings
number_slider = Slider(700, range=0..1000)
# Infos & Settings
panel_9 = Panel("231708_Le toules.3dm")
viewport_1_for_images = Panel("Perspektive")
viewport_2_for_images = Panel("Drauf")
viewport_3_for_images = Panel("Detail")
relpath = RelativePath(Path="Bilder")
multiplication = Multiplication(A=number_slider, B="7")
multiplication_2 = Multiplication(A=number_slider, B="5")
panel_10 = Panel(relpath)
viewport_name_3 = RemoteSender(viewport_3_for_images)
viewport_name_1 = RemoteSender(viewport_1_for_images)
viewport_name_2 = RemoteSender(viewport_2_for_images)
panel_11 = Panel("1446")
panel_12 = Panel(multiplication)
panel_13 = Panel("883")
panel_14 = Panel(multiplication_2)

# ----
# Language translation
list = ValueList({"English": 0, "French": 1, "German": 2}, selected="English")
panel_15 = Panel("C:\Users\Admin\Gruner AG\Jumping dams [EXP] - General\03_Model\Les Toules")
relpath_2 = RelativePath(Path=panel)
relpath_3 = RelativePath(Path="Resources\Translations\Water_fr.txt")
relpath_4 = RelativePath(Path="Resources\Translations\Water_en.txt")
relpath_5 = RelativePath(Path=panel_2)
relpath_6 = RelativePath(Path="Resources\Translations\ArchDam_fr.txt")
relpath_7 = RelativePath(Path="Resources\Translations\ArchDam_en.txt")
label = UiLabel(Label="Freeboard (m)", Style=3)
label_2 = UiLabel(Label=panel_4, Style=3)
label_3 = UiLabel(Label="Minimum water level", Style=3)
scroll_number = UiScrollNumber(Label="(m.asl)", Number=0, Wrap=False, Digits=3)
label_4 = UiLabel(Label="Normal water level (m.asl)", Style=3)
slider = UiSlider(Value=0.5, Bounds=Domain(0, 1), Increment=0.1)
srs = SetSpatialReferenceSystem(SRS="EPSG:2056")
label_5 = UiLabel(Label="Foundation depth (m)", Style=3)
button = UiButton(Label="Ok")
slider_2 = UiSlider(Value=0.5, Bounds=Domain(0, 1), Increment=0.1)
file = ReadFile(File=relpath_2, PerLineParse=True)
file_2 = ReadFile(File=relpath_3, PerLineParse=True)
file_3 = ReadFile(File=relpath_4, PerLineParse=True)
file_4 = ReadFile(File=relpath_5, PerLineParse=True)
file_5 = ReadFile(File=relpath_6, PerLineParse=True)
relpath_8 = RelativePath(Path="Modules\Dashboard_damConfiguration")
relpath_9 = RelativePath(Path="Modules\Embankment.gh")
relpath_10 = RelativePath(Path="Modules\Arch.gh")
relpath_11 = RelativePath(Path=panel_7)
file_6 = ReadFile(File=relpath_7, PerLineParse=True)
english = Panel(file)
french = Panel(file_2)
german = Panel(file_3)
pythonremote = GHPythonRemote(location=panel_5, run=Toggle(False), modules=panel_6)  # -> out, linked_modules, rpy, import_statements
english_2 = Panel(file_4)
french_2 = Panel(file_5)
german_2 = Panel(file_6)
merge = Merge(Data1=label_5, Data2=slider_2)
merge_2 = Merge(Data1=label, Data2=slider)
merge_3 = Merge(Data1=relpath_11, Data2=relpath_10, Data3=relpath_9, Data4=relpath_8)
merge_4 = Merge(Data1=label_3, Data2=scroll_number)
path_save = RemoteSender(panel_15)
panel_16 = Panel(merge_3)
filepath_hops = RemoteSender(merge_3)
panel_17 = Panel(pythonremote.out)
filter = StreamFilter(Gate=list, Stream0=english, Stream1=french, Stream2=german)  # -> flatten(Stream)
filter_2 = StreamFilter(Gate=list, Stream0=english_2, Stream1=french_2, Stream2=german_2)  # -> flatten(Stream)
fields_water = RemoteSender(filter)
fields_archdam = RemoteSender(filter_2)
slider_3 = UiSlider(Element=slider, Label="m", Value="3", Bounds="0 To 5", Increment=".1")
button_2 = UiButton(Element=button, Label="Send changes")
slider_4 = UiSlider(Element=slider_2, Label="m", Value="10", Bounds="0 To 50", Increment=".1")
heights = Panel("1747.5")
adjust_reservoir_to_dam = Button()
run_pre_geometry_of_water = Button()  # disabled
# Select dam type
heights_2 = Panel("""1836
1839
1842
1844""")
run_water_final = Button()
# Run Dam
# Select dam type
list_2 = ValueList({"Concrete gravity dam": "0", "Arch dam": "1", "Embankment dam": "2"}, selected="Arch dam")
dam_configuration = Button()
run_arch_dam = Button()
get_values = UiValues(Element=slider_3)  # -> flatten(Values)
get_values_2 = UiValues(Element=slider_4)  # -> flatten(Values)
get_values_3 = UiValues(Element=button_2)  # -> flatten(Values)
# Dashboard - fill in data and listen to outputs
dam_type_index = Panel("""0
1
2""")
num = Number(heights_2)
minimum_normal_water_level_preset = RemoteSender(heights)
minimum_normal_water_level_preset_2 = RemoteReceiver(minimum_normal_water_level_preset)
scroll_number_2 = UiScrollNumber(Element=scroll_number, Number=minimum_normal_water_level_preset_2, Wrap=False, Digits=Slider(1, range=0..1))
get_values_4 = UiValues(Element=scroll_number_2)  # -> flatten(Values)
minimum_water_level_m_input_from_dashboa = Panel(get_values_4)  # "Minimum water level (m) - Input from Dashboard"
freeboard_m_input_from_dashboard = Panel(get_values)
run_water_final_2 = RemoteSender(run_water_final)
run_water_pre = RemoteSender(adjust_reservoir_to_dam)
offset_foundation_m_input_from_dashboard = Panel(get_values_2)
panel_18 = Panel(get_values_3)
# must be a closed volume!
run_archdam = RemoteSender(run_arch_dam)
sort = SortList(Keys=heights_2, ValuesA=num)  # -> Keys, ValuesA
panel_19 = Panel("""False
False
False""")
list_of_heights = RemoteSender(sort.ValuesA)
list_of_heights_2 = RemoteReceiver(list_of_heights)
dropdown_list = UiDropdownList(Values=list_of_heights_2)
merge_5 = Merge(Data1=label_4, Data2=dropdown_list)
list_of_heights_3 = RemoteReceiver(list_of_heights)
dropdown_list_2 = UiDropdownList(Element=dropdown_list, Values=list_of_heights_3, Index=Slider(0, range=0..10))
get_values_5 = UiValues(Element=dropdown_list_2)  # -> flatten(Values)
item = ListItem(List=list_of_heights_3, Index=get_values_5, Wrap=True)
water_level_m_input_from_dashboard = Panel(item)
replace = ReplaceItems(List=panel_19, Item="True", Indices=list_2, Wrap=False)
dam_selection = RemoteSender(replace)
dam_selection_2 = RemoteReceiver(dam_selection)
panel_20 = Panel(dam_selection_2)
radio = UiRadio(Label=panel_3, State=panel_20, Group="Group 1")
merge_6 = Merge(Data1=label_2, Data2=radio)  # -> flatten(Result)
merge_7 = Merge(Data1=merge_6, Data2=merge_5, Data3=merge_4, Data4=merge_2, Data5=merge, Data6=button)
get_values_6 = UiValues(Element=radio)  # -> flatten(Values)
dam_type = Panel(get_values_6)
dispatch = Dispatch(List=dam_type_index, DispatchPattern=dam_type)  # -> ListA, ListB
dashboard_damconfiguration = RemoteSender(dam_configuration)
dashboard_damconfiguration_2 = RemoteReceiver(dashboard_damconfiguration)
window = UiWindow(Elements=merge_7, Title="Dam Configuration", Owner=1, Scroll=True, Launch=dashboard_damconfiguration_2)
minimum_water_level = RemoteSender(minimum_water_level_m_input_from_dashboa)

dam = DataDam(
    DataA=dispatch.ListA,
    DataB=water_level_m_input_from_dashboard,
    DataC=freeboard_m_input_from_dashboard,
    DataD=offset_foundation_m_input_from_dashboard,
    BufferDelay=5000000,
    BufferMode=1)  # -> DataA, DataB, DataC, DataD
dam_2 = DataDam(DataA=dispatch.ListA, BufferDelay=2500000, BufferMode=1)
objfromgroup = GetObjectsInGroup()

dam_3 = DataDam(DataA=freeboard_m_input_from_dashboard, BufferDelay=10000000, BufferMode=0)  # disabled
dam_4 = DataDam(DataA=offset_foundation_m_input_from_dashboard, BufferDelay=10000000, BufferMode=0)  # disabled

lng = ListLength(List=objfromgroup)
dup = DuplicateData(Data=panel_18, Number=lng, Order=True)

inpupt_offset_foundation_m = Panel(dam.DataD)
addition = Addition(A=dam.DataB, B=dam.DataC)
bool = Boolean(dup)
normal_water_level = RemoteSender(dam.DataB)
dam_level = RemoteSender(addition)
dam_type_2 = RemoteSender(dam_2)
dam_type_3 = RemoteReceiver(dam_type_2)
num_2 = Number(dam_type_3)
S = Script(Language=list, Dam_index=num_2)  # -> out, a
# ---------- S: Python ----------
"""05.10.2023 - CNA"""

if l == 0:
    if i == 0:
        a = "Gravity"
    elif i == 1:
        a = "Arch" 
    elif i == 2:
        a = "Embankment"

if l == 1:
    if i == 0:
        a = "Poids"
    elif i == 1:
        a = "Voûtes" 
    elif i == 2:
        a = "Digue"
# ---------- end S ----------
panel_21 = Panel(S.a)
dam_name_translation = RemoteSender(S.a)
freeboard = RemoteSender(dam.DataC)
offset_foundation = RemoteSender(dam.DataD)
setobj = SetObjectValue(ObjectToSet=flatten(objfromgroup), ValueToSet=flatten(bool))
panel_22 = Panel(lng)
# Formulas - conservative as compared with values computed more precisely (in feet)
panel_23 = Panel(dup)
vector_send_to_local_0 = Panel("{-2.5815e+6,-1.083e+6,0}")
vector_back_to_lv95 = Panel("{2.5815e+6,1.083e+6,0}")
mesh = GeometryPipeline(
    GroupByLayer=False,
    GroupByType=False,
    IncludeHidden=True,
    IncludeLocked=True,
    LayerFilter="Terrain_brep_offset_-10",
    NameFilter="*",
    SublayerFiltering=True,
    TypeFilter=1073741848)
pipeline = GeometryPipeline(
    GroupByLayer=False,
    GroupByType=False,
    IncludeHidden=True,
    IncludeLocked=True,
    LayerFilter="Terrain_levels",
    NameFilter="*",
    SublayerFiltering=True,
    TypeFilter=4)
mesh_2 = GeometryPipeline(
    GroupByLayer=False,
    GroupByType=False,
    IncludeHidden=True,
    IncludeLocked=True,
    LayerFilter="Terrain_brep",
    NameFilter="*",
    SublayerFiltering=True,
    TypeFilter=1073741848)

pipeline_2 = GeometryPipeline(
    GroupByLayer=False,
    GroupByType=False,
    IncludeHidden=True,
    IncludeLocked=True,
    LayerFilter="Gravity::Axes::*",
    NameFilter="*",
    SublayerFiltering=True,
    TypeFilter=4)
pipeline_3 = GeometryPipeline(
    GroupByLayer=False,
    GroupByType=False,
    IncludeHidden=True,
    IncludeLocked=True,
    LayerFilter="Arch::Axes::*",
    NameFilter="*",
    SublayerFiltering=True,
    TypeFilter=4)
pipeline_4 = GeometryPipeline(
    GroupByLayer=False,
    GroupByType=False,
    IncludeHidden=True,
    IncludeLocked=True,
    LayerFilter="Embankment::Axes::*",
    NameFilter="*",
    SublayerFiltering=True,
    TypeFilter=4)
pipeline_5 = GeometryPipeline(
    GroupByLayer=False,
    GroupByType=False,
    IncludeHidden=True,
    IncludeLocked=True,
    LayerFilter="New designs",
    NameFilter="*",
    SublayerFiltering=True,
    TypeFilter=4)

pipeline_6 = GeometryPipeline(
    GroupByLayer=False,
    GroupByType=False,
    IncludeHidden=True,
    IncludeLocked=True,
    LayerFilter="Upstream_point",
    NameFilter="*",
    SublayerFiltering=True,
    TypeFilter=1)
pipeline_7 = GeometryPipeline(
    GroupByLayer=False,
    GroupByType=False,
    IncludeHidden=True,
    IncludeLocked=True,
    LayerFilter="Upstream_point",
    NameFilter="*",
    SublayerFiltering=True,
    TypeFilter=4)
mesh_3 = GeometryPipeline(
    GroupByLayer=False,
    GroupByType=False,
    IncludeHidden=True,
    IncludeLocked=True,
    LayerFilter="Terrain_base_curve",
    NameFilter="*",
    SublayerFiltering=True,
    TypeFilter=4)
dam_type_4 = RemoteReceiver(dam_type_2)
filter_3 = StreamFilter(Gate=dam_type_4, Stream0=pipeline_2, Stream1=pipeline_3, Stream2=pipeline_4)
merge_8 = Merge(Data1=filter_3, Data2=pipeline_5)
details = ContentDetails(Content=merge_8)  # -> Content, Id, Path, Attributes
flip = FlipCurve(Curve=merge_8, Guide=pipeline_7)  # -> Curve, Flag
project = Project(Geometry=flip.Curve, Plane=PlaneXY(0, 0, 0))  # -> Geometry, Transform
panel_24 = Panel(details.Path)
axis_selection = Slider(0, range=0..8)

# ---- group: Automation slider
connected = GetConnectedObjects(Objects=axis_selection)
lng_2 = ListLength(List=merge_8)
x_minus_one = XMinusOne(NumberX=lng_2)
set_slider = SetSliderProperties(Slider=connected, Range=x_minus_one, Type=1)

# ----
transform = Transform({TransformCount=1, Name="Translation", tx=-2580598.7, ty=-1083020.6, tz=0})
explode = Explode(Curve=mesh_3, Recursive=True)  # -> Segments, Vertices
brep = Brep(mesh_3)  # disabled
inverse = InverseTransform(Transform=transform)
item_2 = ListItem(List=project.Geometry, Index=axis_selection, Wrap=True)
item_3 = ListItem(List=details.Path, Index=axis_selection, Wrap=True)
conmesh = ConstructMesh(Vertices=explode.Vertices, Faces={A=0, B=1, C=2, D=3})
transform_origin = RemoteSender(inverse)
brep_terrain_base_foundation = RemoteSender(mesh)
panel_25 = Panel(item_3)
dam_5 = DataDam(DataAxis=item_2, DataName=item_3, BufferDelay=10000000, BufferMode=0)  # -> DataAxis, DataName
mesh_terrain_flattened = RemoteSender(conmesh)
brep_terrain_base = RemoteSender(brep)  # disabled
brep_terrain = RemoteSender(mesh_2)
lines_levels = RemoteSender(pipeline)
dam_axis_name = RemoteSender(dam_5.DataName)
dam_axis = RemoteSender(dam_5.DataAxis)
dam_level_2 = RemoteReceiver(dam_level)
brep_terrain_base_foundation_2 = RemoteReceiver(brep_terrain_base_foundation)
dam_axis_2 = RemoteReceiver(dam_axis)

# ---- group: Selecting dam height level
# This changes when the axis line calculate and recalculate the basics again
brep_terrain_2 = RemoteReceiver(brep_terrain)

# ----
Z = UnitZ(Factor=dam_level_2)
move = Move(Geometry=dam_axis_2, Motion=Z)  # -> Geometry, Transform
# Technical Memorandum No. EM36-86-68110: 2.1.3 Lines of Centers
# 
# The lines of centers define the horizontal shape of the arches in an arch dam. The shape of the arches starts at the crown cantilever and curves horizontally downstream toward the abutments. The line of centers create the geometry of the circular arcs at each elevation of the dam for the upstream and downstream faces by defining the center point of a circle and the radius of the circle. Depending on the shape and number of lines of centers, the arches can be
# 1) uniform thickness from abutment to abutment,
# 2) variable thickness from abutment to abutment,
# 3) different on the left side of the dam compared to the right side of the dam, or
# 4) different in the center of the dam compared to the outer part of the dam.
# Technical Memorandum No. EM36-86-68110: A double curvature arch dam has curvature in the arches and in the crown cantilever.
panel_26 = Panel(" 1 meter = 3.28084 feet")
normal_water_level_2 = RemoteReceiver(normal_water_level)
dam_level_3 = RemoteReceiver(dam_level)
scx = SurfaceCurve(Surface=brep_terrain_2, Curve=move.Geometry)  # -> Curves, flatten(Points), UVPoints, Normals, Parameters, Tangents
Z_2 = UnitZ(Factor=dam_level_3)

# ---- group: Finding the crest points at bottom EXCAVATION
scx_2 = SurfaceCurve(Surface=brep_terrain_base_foundation_2, Curve=move.Geometry)  # -> Curves, flatten(Points), UVPoints, Normals, Parameters, Tangents
item_4 = ListItem(List=scx_2.Points, Index=0, Wrap=True)  # -> Item, Item1

# ----
Z_3 = UnitZ(Factor=normal_water_level_2)
sec = BrepPlane(Brep=brep_terrain_2, Plane=Z_3)  # -> Curves, Points
sec_2 = BrepPlane(Brep=brep_terrain_2, Plane=Z_2)  # -> Curves, Points
item_5 = ListItem(List=scx.Points, Index=0, Wrap=True)  # -> Item, Item1
ln = Line(StartPoint=item_5.Item, EndPoint=item_5.Item1)

# ---- group: AXIS LINE
ln_2 = Line(StartPoint=item_4.Item, EndPoint=item_4.Item1)

# ----
join = JoinCurves(Curves=sec_2.Curves, Preserve=True)
join_2 = JoinCurves(Curves=sec.Curves, Preserve=False)
len = Length(Curve=ln)
chord_dam = RemoteSender(ln_2)
txt = Text(join_2)
txt_2 = Text(join)
axis_straight_terrain = RemoteSender(len)
downstream_face_angle_ratio_1 = Slider(0.8, range=0..1)
downstream_face_angle_ratio_1_2 = Slider(0.8, range=0..1)
dam_crest_width = Slider(20, range=0..100)
dam_crest_width_2 = Slider(6, range=0..100)
mindex = MemberIndex(Set=txt, Member="Closed Planar Curve")  # -> Index, Count
mindex_2 = MemberIndex(Set=txt_2, Member="Closed Planar Curve")  # -> Index, Count
cull_i = CullIndex(List=join_2, Indices=mindex.Index, Wrap=True)
cull_i_2 = CullIndex(List=join, Indices=mindex_2.Index, Wrap=True)
embankment_width_crest = RemoteSender(dam_crest_width)
gravity_width_crest = RemoteSender(dam_crest_width_2)
embankment_ds_ration = RemoteSender(downstream_face_angle_ratio_1)
gravity_ds_ration = RemoteSender(downstream_face_angle_ratio_1_2)
len_2 = Length(Curve=cull_i_2)
len_3 = Length(Curve=cull_i)
larger = LargerThan(FirstNumber=len_2, SecondNumber=Slider(2, range=0..10))  # -> LargerThan, OrEqualTo
larger_2 = LargerThan(FirstNumber=len_3, SecondNumber=Slider(2, range=0..10))  # -> LargerThan, OrEqualTo
dispatch_2 = Dispatch(List=cull_i_2, DispatchPattern=larger.LargerThan)  # -> ListA, ListB
dispatch_3 = Dispatch(List=cull_i, DispatchPattern=larger_2.LargerThan)  # -> ListA, ListB
end = EndPoints(Curve=dispatch_2.ListA)  # -> Start, End
# surface
brep_terrain_base_foundation_3 = RemoteReceiver(brep_terrain_base_foundation)
end_2 = EndPoints(Curve=dispatch_3.ListA)  # -> Start, End
# number
embankment_ds_ration_2 = RemoteReceiver(embankment_ds_ration)
# surface
brep_terrain_base_foundation_4 = RemoteReceiver(brep_terrain_base_foundation)
# number
embankment_width_crest_2 = RemoteReceiver(embankment_width_crest)
# line
chord_dam_2 = RemoteReceiver(chord_dam)
pt = Point([end.Start, end.End])
# number
gravity_width_crest_2 = RemoteReceiver(gravity_width_crest)
# number
gravity_ds_ration_2 = RemoteReceiver(gravity_ds_ration)
pt_2 = Point([end_2.Start, end_2.End])
# line
chord_dam_3 = RemoteReceiver(chord_dam)
incurve = PointInCurve(Point=pt, Curve=mesh_3)  # -> Relationship, Point
incurve_2 = PointInCurve(Point=pt_2, Curve=mesh_3)  # -> Relationship, Point
list_3 = ValueList({"Concrete gravity dam": 0, "Arch dam": 1, "Embankment dam": 2}, selected="Concrete gravity dam")  # disabled
filepath_hops_2 = RemoteReceiver(filepath_hops)  # disabled
equals = Equality(FirstNumber=incurve.Relationship, SecondNumber="2")  # -> Equality, Inequality
equals_2 = Equality(FirstNumber=incurve_2.Relationship, SecondNumber="2")  # -> Equality, Inequality
dispatch_4 = Dispatch(List=pt, DispatchPattern=equals.Equality)  # -> ListA, ListB
dispatch_5 = Dispatch(List=pt_2, DispatchPattern=equals_2.Equality)  # -> ListA, ListB
item_6 = ListItem(List=filepath_hops_2, Index=list_3, Wrap=True)  # disabled
brep_terrain_base_foundation_5 = RemoteReceiver(brep_terrain_base_foundation)  # disabled
panel_27 = Panel("""All in meters

Dam height: {3}
Radius = 0.6xL1 + Adjustment = {0} + {8} : {9}
L1: {1}
tc: {2}
USP base: {4}
DSP base: {5}
USP @ 0.45H: {6}
Volume if calculated with the equations: {7}
Free board: {10}
Offset foundation: {11}""")
pline = PolyLine(Vertices=dispatch_4.ListA, Closed=False)
brep_terrain_base_foundation_6 = RemoteReceiver(brep_terrain_base_foundation)
pline_2 = PolyLine(Vertices=dispatch_5.ListA, Closed=False)
panel_28 = Panel(item_6)  # disabled
panel_29 = Panel("""Radius: {9}
L1: {1}
tc: {2}
USP base: {4}
DSP base: {5}
USP at 45%H: {6}
Volume if calculated with the equations: {7}
Free board: {10}
Offset foundation: {11}""")
gravity_ds_ration_3 = RemoteReceiver(gravity_ds_ration)  # disabled
offset_foundation_2 = RemoteReceiver(offset_foundation)
chord_dam_4 = RemoteReceiver(chord_dam)  # disabled
width_crest = RemoteReceiver()  # disabled
# ARCH DAM
brep_terrain_3 = RemoteReceiver(brep_terrain)
chord_dam_5 = RemoteReceiver(chord_dam)
join_3 = JoinCurves(Curves=[dispatch_2.ListA, pline], Preserve=False)
freeboard_2 = RemoteReceiver(freeboard)
chord_dam_6 = RemoteReceiver(chord_dam)
join_4 = JoinCurves(Curves=[dispatch_3.ListA, pline_2], Preserve=False)
offset_foundation_3 = RemoteReceiver(offset_foundation)
freeboard_3 = RemoteReceiver(freeboard)
path = FilePath(panel_28)  # disabled
levels_at_water_height = RemoteSender(join_4)

raxis_adjustments = Slider(20, range=-30..30)

levels_dam_height = RemoteSender(join_3)
hops = Hops(
    _Path=path,
    CacheResultsInMemory=True,
    CacheSolveResults=True,
    RemoteDefinitionLocation="C:\Users\Admin\Documents\Github\EarlyStageDesign\JD\Skripts\Modules\Gravity.gh",
    RemoteSolveVersion=(0, 1, 0),
    ShowInput_Enabled=False,
    ShowInput_Path=True,
    SynchronousSolve=True)  # disabled
list_4 = ValueList({"Concrete gravity dam": 0, "Arch dam": 1, "Embankment dam": 2}, selected="Arch dam")
dam_type_5 = RemoteReceiver(dam_type_2)
equals_3 = Equality(FirstNumber=dam_type_5, SecondNumber=list_4)  # -> Equality, Inequality
normal_water_level_3 = RemoteReceiver(normal_water_level)
mesh_terrain_flattened_2 = RemoteReceiver(mesh_terrain_flattened)
minimum_water_level_2 = RemoteReceiver(minimum_water_level)
dam_axis_3 = RemoteReceiver(dam_axis)

# ---- group: Split what is undergound and above ground - Runs once that the file opens
# Split what is undergound and above ground - Runs once that the file opens
brep_terrain_4 = RemoteReceiver(brep_terrain)
bbox = BoundingBox(Content=brep_terrain_4, Plane=PlaneXY(0, 0, 0))  # -> Box, Box_2
jagged = SettingsSpeed()
mesh_4 = MeshBrep(Brep=bbox.Box, Settings=jagged)
mesh_5 = MeshBrep(Brep=brep_terrain_4, Settings=jagged)
msplit = MeshSplit(Mesh=mesh_4, Splitters=mesh_5)
item_7 = ListItem(List=msplit, Index=0, Wrap=True)  # -> Item, Item1
bottom_part = Geometry(item_7.Item)
uper_part = Geometry(item_7.Item1)
mjoin = MeshJoin(Meshes=flatten([uper_part, mesh_5]))
weldvertices = MeshWeldVertices(Mesh=mjoin, Tolerance=0.01)  # -> RuntimeMessage, Mesh
clsmsh = CloseMesh(Mesh=weldvertices.Mesh, Quadrangulate=False)  # -> Closed, Amount, Openings, R

# ----
# Runs the volume of the water for the normal water level height, splits the dead storage and split the water in 10 m levels
# 
# It takes a couple of minutes to run (tested 05.10.23 - 1.1 m)
run_water_pre_2 = RemoteReceiver(run_water_pre)

dam_6 = DataDam(
    DataAxisDam=dam_axis_3,
    DataMeshTerrainFlattened=mesh_terrain_flattened_2,
    DataNormalWaterLevel=normal_water_level_3,
    DataMinimumStorageLevel=minimum_water_level_2,
    BufferDelay=10000000,
    BufferMode=0)  # -> DataAxisDam, DataMeshTerrainFlattened, DataNormalWaterLevel, DataMinimumStorageLevel
objfromgroup_2 = GetObjectsInGroup()

angle = Angle()  # -> Angle, Reflex
setobj_2 = SetObjectValue(ObjectToSet=objfromgroup_2, ValueToSet=run_water_pre_2)
Z_4 = UnitZ(Factor=dam_6.DataNormalWaterLevel)
Z_5 = UnitZ(Factor=dam_6.DataMinimumStorageLevel)
mesh_6 = Mesh(dam_6.DataMeshTerrainFlattened)
pln = Plane(Z_4)
pln_2 = Plane(Z_5)
panel_30 = Panel(Z_5)
movetoplane = MoveToPlane(Geometry=mesh_6, Plane=pln, Above=True, Below=True)  # -> Geometry, Transform
movetoplane_2 = MoveToPlane(Geometry=mesh_6, Plane=pln_2, Above=True, Below=True)  # -> Geometry, Transform
project_2 = Project(Curve=dam_6.DataAxisDam, Brep=bbox.Box, Direction=Vector(0, 0, 1))
mesh_7 = Mesh(project_2)
list_5 = ValueList({"Concrete gravity dam": 0, "Arch dam": 1, "Embankment dam": 2}, selected="Embankment dam")
list_6 = ValueList({"Concrete gravity dam": 0, "Arch dam": 1, "Embankment dam": 2}, selected="Concrete gravity dam")
dam_type_6 = RemoteReceiver(dam_type_2)
dam_type_7 = RemoteReceiver(dam_type_2)
equals_4 = Equality(FirstNumber=dam_type_6, SecondNumber=list_5)  # -> Equality, Inequality
equals_5 = Equality(FirstNumber=dam_type_7, SecondNumber=list_6)  # -> Equality, Inequality

# ---- group: Divide on axis
msplit_2 = MeshSplit(Mesh=clsmsh.Closed, Splitters=mesh_7)
item_8 = ListItem(List=msplit_2, Index=0, Wrap=True)
clsmsh_2 = CloseMesh(Mesh=item_8, Quadrangulate=False)  # -> Closed, Amount, Openings, R

# ---- group: Divide dead storage capacity from the rest
msplit_3 = MeshSplit(Mesh=clsmsh_2.Closed, Splitters=movetoplane_2.Geometry)
clean = CleanTree(RemoveNulls=True, RemoveInvalid=True, RemoveEmpty=False, Tree=msplit_3)
cull_i_3 = CullIndex(List=clean, Indices="0", Wrap=True)
item_9 = ListItem(List=clean, Index=0, Wrap=True)
clsmsh_3 = CloseMesh(Mesh=cull_i_3, Quadrangulate=False)  # -> Closed, Amount, Openings, R
clsmsh_4 = CloseMesh(Mesh=item_9, Quadrangulate=False)  # -> Closed, Amount, Openings, R

# ----
dead_storage = Mesh(flatten(clsmsh_3.Closed))
rest = Mesh(clsmsh_4.Closed)

# ---- group: Splitting the rest to the normal water level
msplit_4 = MeshSplit(Mesh=rest, Splitters=movetoplane.Geometry)
clean_2 = CleanTree(RemoveNulls=True, RemoveInvalid=True, RemoveEmpty=False, Tree=msplit_4)
cull_i_4 = CullIndex(List=clean_2, Indices="0", Wrap=True)
item_10 = ListItem(List=cull_i_4, Index=0, Wrap=True)  # -> Item, Item1
geo = Geometry(item_10.Item)

# ---- group: Dividing the levels
bbox_2 = BoundingBox(Content=geo, Plane=PlaneXY(0, 0, 0), UnionBox=True)  # -> Box, Box_2
contour = Contour(Shape=bbox_2.Box, Point=Point(0, 0, 0), Direction=Vector(0, 0, 1), Distance=Slider(10, range=0..100))  # -> flatten(Contours)
mesh_8 = Mesh(contour)
msplit_5 = MeshSplit(Mesh=geo, Splitters=mesh_8)

# ---- group: Sorting levels in the same branch
Z_6 = UnitZ(Factor=Slider(0.1, range=0..0.1))
move_2 = Move(Geometry=mesh_8, Motion=Z_6)  # -> Geometry, Transform
clean_3 = CleanTree(RemoveNulls=True, RemoveInvalid=True, RemoveEmpty=False, Tree=flatten(msplit_5))
graft = GraftTree(Tree=move_2.Geometry, IncludeEmptyLists=True, IncludeNullItems=True)
clash = Clash(FirstSet=clean_3, SecondSet=graft, Distance=0, L=100)  # -> ClashCount, ClashPoints, ClashRadii, FirstIndex, SecondIndex
item_11 = ListItem(List=clean_3, Index=clash.FirstIndex, Wrap=True)
clean_4 = CleanTree(RemoveNulls=True, RemoveInvalid=True, RemoveEmpty=True, Tree=item_11)
mjoin_2 = MeshJoin(Meshes=clean_4)
disjoint = DisjointMesh(Mesh=mjoin_2)
clsmsh_5 = CloseMesh(Mesh=disjoint, Quadrangulate=True)  # -> Closed, Amount, Openings, R

# ---- group: Filtering too small meshes - assumption that the not so detailed mesh will produce some weird shapes
path_mapper = PathMapper(clsmsh_5.Closed, source="{A;B;C;D}", target="{path_index}")
volume = MeshVolume(Mesh=path_mapper)  # -> Volume, Centroid
larger_3 = LargerThan(FirstNumber=volume.Volume, SecondNumber=Slider(150, range=0..150))  # -> LargerThan, OrEqualTo
dispatch_6 = Dispatch(List=volume.Volume, DispatchPattern=larger_3.LargerThan)  # -> simplify(ListA), ListB
dispatch_7 = Dispatch(List=path_mapper, DispatchPattern=larger_3.LargerThan)  # -> ListA, ListB
mjoin_3 = MeshJoin(Meshes=dispatch_7.ListA)  # -> simplify(Mesh)

# ----
mesh_9 = Mesh(dead_storage)
bool_2 = Boolean(False)
bool_3 = Boolean(True)
merge_9 = Merge(Data1=flatten(mjoin_3), Data2=flatten(mesh_9))  # -> simplify(graft(Result))
dup_2 = DuplicateDataMatch(SourceDataTree=mesh_9, SecondaryData1=bool_3)  # -> SourceData, SecondaryData1
dup_3 = DuplicateDataMatch(SourceDataTree=mjoin_3, SecondaryData1=bool_2)  # -> SourceData, SecondaryData1
merge_10 = Merge(Data1=flatten(dup_3.SecondaryData1), Data2=flatten(dup_2.SecondaryData1))  # -> simplify(graft(Result))
dam_type_8 = RemoteReceiver(dam_type_2)
dam_type_9 = RemoteReceiver(dam_type_2)
null = NullPlaceholder()
# Adapt water volume to dam shape
# Adjusts the water sections to the dam section - it is already cutted at the straight axis, but it has to adapt for the arch dam
run_water_final_3 = RemoteReceiver(run_water_final_2)
objfromgroup_3 = GetObjectsInGroup()
dup_4 = DuplicateDataMatch(SourceDataTree=objfromgroup_3, SecondaryData1=run_water_final_3)  # -> SourceData, SecondaryData1
dam_type_10 = RemoteReceiver(dam_type_2)
dam_type_11 = RemoteReceiver(dam_type_2)
setobj_3 = SetObjectValue(ObjectToSet=objfromgroup_3, ValueToSet=dup_4.SecondaryData1)
dam_type_12 = RemoteReceiver(dam_type_2)
number_slider_2 = Slider(8, range=0..10)  # disabled
toggle = BooleanToggle(True)  # disabled
number_slider_3 = Slider(1, range=0..1)  # disabled
ma = MassAddition(Input=flatten(dispatch_6.ListA))  # -> Result, PartialResults; disabled
panel_31 = Panel(ma.Result)  # disabled
dam_type_13 = RemoteReceiver(dam_type_2)
dam_type_14 = RemoteReceiver(dam_type_2)
item_12 = ListItem(Index=0, Wrap=True)
jagged_2 = SettingsSpeed()
number_slider_4 = Slider(1, range=0..1)
# Export Shapefile
# Export water
path_save_2 = RemoteReceiver(path_save)
as_text = AnnotationTextSettings(TextHeight=Slider(6, range=0..100))  # -> TextSettings, Font, TextHeight, TextGap, MaskFrame, MaskColour, MaskMargins, HorizontalAlignment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
font_size = RemoteSender(Slider(12, range=0..100))
panel_32 = Panel(path_save_2)
leader_text_settings = RemoteSender(as_text.TextSettings)
show_line_of_centers = BooleanToggle(False)
normal_water_level_4 = RemoteReceiver(normal_water_level)
dam_name_translation_2 = RemoteReceiver(dam_name_translation)
dam_axis_name_2 = RemoteReceiver(dam_axis_name)
transform_origin_2 = RemoteReceiver(transform_origin)
fields_water_2 = RemoteReceiver(fields_water)
# Export axis
normal_water_level_5 = RemoteReceiver(normal_water_level)
dam_name_translation_3 = RemoteReceiver(dam_name_translation)
dam_axis_name_3 = RemoteReceiver(dam_axis_name)
chord_dam_7 = RemoteReceiver(chord_dam)
transform_origin_3 = RemoteReceiver(transform_origin)
fields_archdam_2 = RemoteReceiver(fields_archdam)
# Export arch dam
number_slider_5 = Slider(1, range=0..1)
normal_water_level_6 = RemoteReceiver(normal_water_level)
dam_name_translation_4 = RemoteReceiver(dam_name_translation)
dam_axis_name_4 = RemoteReceiver(dam_axis_name)
dam_name_translation_5 = RemoteReceiver(dam_name_translation)
normal_water_level_7 = RemoteReceiver(normal_water_level)
as_leaders = AnnotationLeaderSettings()  # -> LeaderSettings, LeaderCurveType, HasLanding, LandingLength, LeaderTextOrientation, HorizontalTextAlignment, VerticalTextAlignment
dam_axis_name_5 = RemoteReceiver(dam_axis_name)
fields_archdam_3 = RemoteReceiver(fields_archdam)
time = Time("now")
transform_2 = Transform(Geometry=chord_dam_7, Transform=transform_origin_3)
dam_level_4 = RemoteReceiver(dam_level)
concat = Concatenate(
    FragmentA=normal_water_level_4,
    FragmentB="Water",
    FragmentC=dam_name_translation_2,
    FragmentD=dam_axis_name_2,
    JoinSeparator="_")
concat_2 = Concatenate(
    FragmentA=normal_water_level_6,
    FragmentB="ArchDam",
    FragmentC=dam_name_translation_4,
    FragmentD=dam_axis_name_4,
    JoinSeparator="_")
concat_3 = Concatenate(
    FragmentA=normal_water_level_5,
    FragmentB="Axis",
    FragmentC=dam_name_translation_3,
    FragmentD=dam_axis_name_3,
    JoinSeparator="_")
ddate = DeconstructDate(Date=time)  # -> Year, Month, Day, Hour, Minute, Second
item_13 = ListItem(List=fields_archdam_2, Index=number_slider_5, Wrap=True)
crv = Curve(transform_2)
panel_33 = Panel(fields_water_2)
panel_34 = Panel(concat)
panel_35 = Panel(concat_3)
concat_4 = Concatenate(FragmentD="Export\ArcGIS", FragmentA=ddate.Year, FragmentB=ddate.Month, FragmentC=ddate.Day, JoinSeparator="_")
panel_36 = Panel(concat_2)
panel_37 = Panel(fields_archdam_3)
transform_origin_4 = RemoteReceiver(transform_origin)
concat_5 = Concatenate(FragmentA=panel_32, FragmentB=concat_4, JoinSeparator="\")
panel_38 = Panel(concat_5)
show_text = BooleanToggle(True)
dam_axis_name_6 = RemoteReceiver(dam_axis_name)
path_2 = FilePath(panel_38)
path_save_arcgis = RemoteSender(path_2)
path_save_arcgis_2 = RemoteReceiver(path_save_arcgis)
path_save_arcgis_3 = RemoteReceiver(path_save_arcgis)
path_save_arcgis_4 = RemoteReceiver(path_save_arcgis)
panel_39 = Panel(path_save_arcgis_2)
panel_40 = Panel(path_save_arcgis_3)
panel_41 = Panel(path_save_arcgis_4)
send_to_export = Button()
swatch = ColourSwatch(SwatchColor=RGB(0, 232, 155))
brep_terrain_5 = RemoteReceiver(brep_terrain)
swatch_2 = ColourSwatch(SwatchColor=RGB(207, 255, 255))
swatch_3 = ColourSwatch(SwatchColor=RGB(72, 212, 212))
material = CreateMaterial(
    Diffuse=ColourSwatch(SwatchColor=RGB(125, 161, 125)),
    Specular=ColourSwatch(SwatchColor=RGB(194, 91, 91)),
    Emission=ColourSwatch(SwatchColor=RGB(196, 255, 247)),
    Transparency=Slider(0.14, range=0..1),
    Shine=0)
material_2 = CreateMaterial(
    Diffuse=swatch_3,
    Specular=swatch_3,
    Emission=swatch_3,
    Transparency=Slider(0.8, range=0..1),
    Shine=Slider(0, range=0..100))
preview = CustomPreview(Geometry=brep_terrain_5, Material=material)
show_dead_capacity = BooleanToggle(True)
show_useful_capacity = BooleanToggle(True)
panel_42 = Panel("BG + 20m for radius")  # disabled
normal_water_level_8 = RemoteReceiver(normal_water_level)  # disabled
panel_43 = Panel("""Water level:
{0}
Dam crest level: 
{1}
Level foundation:
{2}
Arch dam height:
{3}
Straight axis lenght - to terrain:
{4}
Straight axis lenght - to bottom foundation:
{5}
Arch dam axis length - to bottom foundation:
{6}
Volume arch dam:
{7}""")  # disabled
concat_6 = Concatenate(FragmentA=panel_42, FragmentB=normal_water_level_8, JoinSeparator="-")  # disabled
pdecon = Deconstruct()  # -> XComponent, YComponent, ZComponent; disabled
path_save_3 = RemoteReceiver(path_save)  # disabled
geo_2 = Geometry()  # disabled
axis_straight_terrain_2 = RemoteReceiver(axis_straight_terrain)  # disabled
panel_44 = Panel("""Top
Perspective
Front
Right""")  # disabled
normal_water_level_9 = RemoteReceiver(normal_water_level)  # disabled
button_3 = Button()  # disabled
panel_45 = Panel("Wireframe")  # disabled
dam_level_5 = RemoteReceiver(dam_level)  # disabled
len_4 = Length(Curve=geo_2)  # disabled
panel_46 = Panel("3840")  # disabled
panel_47 = Panel("2160")  # disabled
normal_water_level_10 = RemoteReceiver(normal_water_level)  # disabled
dam_level_6 = RemoteReceiver(dam_level)  # disabled
captureview = LBCaptureView(
    file_name=concat_6,
    folder=path_save_3,
    viewport=panel_44,
    width=panel_46,
    height=panel_47,
    mode=panel_45,
    capture=button_3)  # -> file; disabled; plug-in component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
cadexporter = CADExporter(Export=False, ExportType="dwg")  # disabled
panel_48 = Panel("""Water level
Dam crest level 
Level foundation
Dam height
Straight axis lenght - to terrain
Straight axis lenght - to bottom foundation
Arch dam axis length - to bottom foundation
Volume arch dam""")  # disabled
panel_49 = Panel(":")  # disabled
transform_origin_5 = RemoteReceiver(transform_origin)  # disabled
panel_50 = Panel("""Field's names
Values""")  # disabled
panel_51 = Panel("|")  # disabled
panel_52 = Panel("|")  # disabled
panel_53 = Panel("_water")  # disabled
transform_origin_6 = RemoteReceiver(transform_origin)  # disabled
path_save_4 = RemoteReceiver(path_save)  # disabled
concat_7 = Concatenate(FragmentA=concat_6, FragmentB=panel_53)  # disabled
panel_54 = Panel(path_save_4)  # disabled
panel_55 = Panel("Volume")  # disabled
panel_56 = Panel("ArcGIS_TEST")  # disabled
button_4 = Button()  # disabled
toggle_2 = BooleanToggle(False)  # disabled
num_3 = Number()  # disabled
button_5 = Button()  # disabled
concat_8 = Concatenate(FragmentA=panel_54, FragmentB=panel_56, JoinSeparator="\")  # disabled
button_6 = Button()  # disabled
panel_57 = Panel("https://epsg.io/2056")  # disabled
panel_58 = Panel("1")  # disabled
panel_59 = Panel("Test 1")  # disabled
panel_60 = Panel("EPSG:2056")  # disabled
srs_2 = SetSpatialReferenceSystem(SRS=panel_60)  # disabled
panel_61 = Panel(concat_7)  # disabled

dam_axis_4 = RemoteReceiver(dam_axis)

point_upstream = RemoteSender(pipeline_6)

point_upstream_2 = RemoteReceiver(point_upstream)
crv_cp = CurveClosestPoint(Point=point_upstream_2, Curve=dam_axis_4)  # -> Point, Parameter, Distance
vec2pt = Vector2Pt(PointA=point_upstream_2, PointB=crv_cp.Point, Unitize=False)  # -> Vector, Length

vdisex = VectorDisplayEx(Point=point_upstream_2, Vector=vec2pt.Vector, Colour=RGB(0, 0, 0), Width=2)  # disabled
# For optimization: Make perpendicular
# sections on the river line to discover
# best placement for the Dams.
panel_62 = Panel(vec2pt.Vector)

vector_waterflow = RemoteSender(vec2pt.Vector)

# ----
# vector
vector_waterflow_2 = RemoteReceiver(vector_waterflow)
# vector
vector_waterflow_3 = RemoteReceiver(vector_waterflow)

# ----
# EMBANKMENT DAM
# Top
# Concrete dam settings
# Final volume
midpt = CurveMiddle(Curve=chord_dam_2)  # disabled
project_3 = Project(Curve=chord_dam_2, Brep=brep_terrain_base_foundation_3, Direction=Vector(0, 0, 1))  # disabled
end_3 = EndPoints(Curve=chord_dam_2)  # -> Start, End; disabled
x_tremez = Extremes(Curve=project_3, Plane=PlaneXY(0, 0, 0))  # -> Highest, Lowest; disabled
pdecon_2 = Deconstruct(Point=x_tremez.Lowest)  # -> XComponent, YComponent, ZComponent; disabled
pdecon_3 = Deconstruct(Point=midpt)  # -> XComponent, YComponent, ZComponent; disabled
subtraction = Subtraction(A=pdecon_3.ZComponent, B=pdecon_2.ZComponent)  # disabled
multiplication_3 = Multiplication(A=subtraction, B=1.5)  # disabled
panel_63 = Panel("{0,0,-1}")  # disabled
atan = ArcTangent(Value=embankment_ds_ration_2)  # disabled
line = LineSDL(Start=end_3.Start, Direction=panel_63, Length=multiplication_3)  # disabled
rotax = RotateAxis(Geometry=line, Angle=atan, Axis=chord_dam_2)  # -> Geometry, Transform; disabled
neg = Negative(Value=atan)  # disabled
rotax_2 = RotateAxis(Geometry=line, Angle=neg, Axis=chord_dam_2)  # -> Geometry, Transform; disabled
swp1 = Sweep1(Rail=chord_dam_2, Sections=rotax_2.Geometry, Miter=1)  # -> flatten(Brep); disabled
swp1_2 = Sweep1(Rail=chord_dam_2, Sections=rotax.Geometry, Miter=1)  # -> flatten(Brep); disabled
swp1_3 = Sweep1(Rail=chord_dam_2, Sections=line, Miter=1)  # -> flatten(Brep); disabled
embankment_face_collision = RemoteSender(swp1)  # disabled
entwine = Entwine(Branch00=swp1, Branch01=swp1_3, Branch02=swp1_2, FlattenInputs=True)  # -> simplify(Result); disabled
bbx = BrepBrep(BrepA=entwine, BrepB=brep_terrain_base_foundation_3)  # -> Curves, Points; disabled
geo_3 = Geometry(bbx.Curves)  # disabled
explode_2 = Explode(Curve=geo_3, Recursive=False)  # -> Segments, Vertices; disabled
pline_3 = PolyLine(Vertices=explode_2.Vertices, Closed=False)  # disabled
lng_3 = ListLength(List=explode_2.Vertices)  # disabled
number_slider_6 = Slider(0.1, range=0..1)  # disabled
panel_64 = Panel("2")  # disabled
division = Division(A=embankment_width_crest_2, B=panel_64)  # disabled
smoothpline = SmoothPolyline(Polyline=pline_3, Strength=number_slider_6, Times=lng_3)  # disabled
amp = Amplitude(Vector=vector_waterflow_2, Amplitude=division)  # disabled
srfsplit = SurfaceSplit(Surface=entwine, Curves=smoothpline)  # disabled
neg_2 = Negative(Value=amp)  # disabled
center = Center(Geometric=srfsplit, referenceAll=2)  # -> Center, Dimension; disabled
merge_11 = Merge(Data1=neg_2, Data2=amp)  # -> flatten(Result); disabled
pt_3 = Point(midpt)  # disabled
sort_2 = SortList(Keys=center.Dimension, ValuesA=srfsplit)  # -> Keys, ValuesA; disabled
move_3 = Move(Geometry=pt_3, Motion=merge_11)  # -> Geometry, Transform; disabled
item_14 = ListItem(List=sort_2.ValuesA, Index=0, Wrap=True)  # -> simplify(Item); disabled
loft = Loft(
    Curves=flatten(smoothpline),
    Options={Adjust=True, Closed=False, LoftEnds=0, LoftSimp=2, LoftType=5, Rebuild=10, Refit=0.01})  # disabled
simplify = SimplifyTree(Tree=smoothpline, Front=False)  # disabled
bang = ExplodeTree(Data=item_14)  # -> Branch0, Branch1, Branch2; disabled
geo_4 = Geometry([bang.Branch0, bang.Branch2])  # disabled
unflatten = UnflattenTree(Tree=move_3.Geometry, Guide=geo_4)  # disabled
tstat = TreeStatistics(Tree=geo_4)  # -> Paths, Length, Count; disabled
dup_5 = DuplicateDataMatch(SourceDataTree=pt_3, SecondaryData1=unflatten)  # -> SourceData, SecondaryData1; disabled
panel_65 = Panel("0,0,-1")  # disabled
branch = TreeBranch(Tree=simplify, Path=tstat.Paths, MaintainPaths=True)  # disabled
join_5 = BrepJoin(Breps=flatten([geo_4, loft]))  # -> Breps, Closed; disabled
project_4 = ProjectPoint(Point=unflatten, Direction=panel_65, Geometry=geo_4)  # -> Point, Index; disabled
pline_4 = PolyLine(Vertices=[unflatten, project_4.Point, dup_5.SourceData], Closed=True)  # disabled
number_slider_7 = Slider(100, range=0..100)  # disabled
dup_6 = DuplicateDataMatch(SourceDataTree=chord_dam_2, SecondaryData1=pline_4, Clean_Tree=True)  # -> SourceData, SecondaryData1; disabled
move2pt = MoveToPoint(Geometry=pline_4, PointA=pt_3, PointB=end_3.Start)  # -> Moved, Vector, Transform; disabled
Z_7 = UnitZ(Factor=number_slider_7)  # disabled
swp1_4 = Sweep1(Rail=dup_6.SourceData, Sections=move2pt.Moved, Miter=1)  # disabled
extr = Extrude(Base=branch, Direction=Z_7)  # disabled
split = SplitBrep(Brep=swp1_4, Cutter=extr)  # disabled
center_2 = Center(Geometric=split, referenceAll=2)  # -> Center, Dimension; disabled
sort_3 = SortList(Keys=center_2.Dimension, ValuesA=split)  # -> Keys, reverse(ValuesA); disabled
item_15 = ListItem(List=sort_3.ValuesA, Index=0, Wrap=True)  # disabled
capex = CapHolesEx(Brep=item_15)  # -> Brep, Caps, Solid; disabled
sunion = SolidUnion(Breps=flatten([capex.Brep, join_5.Breps]))  # disabled
jagged_3 = SettingsSpeed()  # disabled
mesh_10 = MeshBrep(Brep=sunion, Settings=jagged_3)  # disabled
objfromgroup_4 = GetObjectsInGroup()

# ----
# GRAVITY DAM
# Top
# Concrete dam settings
# Final volume
midpt_2 = CurveMiddle(Curve=chord_dam_3)  # disabled
project_5 = Project(Curve=chord_dam_3, Brep=brep_terrain_base_foundation_4, Direction=Vector(0, 0, 1))  # disabled
end_4 = EndPoints(Curve=chord_dam_3)  # -> Start, End; disabled
x_tremez_2 = Extremes(Curve=project_5, Plane=PlaneXY(0, 0, 0))  # -> Highest, Lowest; disabled
pdecon_4 = Deconstruct(Point=x_tremez_2.Lowest)  # -> XComponent, YComponent, ZComponent; disabled
pdecon_5 = Deconstruct(Point=midpt_2)  # -> XComponent, YComponent, ZComponent; disabled
subtraction_2 = Subtraction(A=pdecon_5.ZComponent, B=pdecon_4.ZComponent)  # disabled
multiplication_4 = Multiplication(A=subtraction_2, B=1.5)  # disabled
panel_66 = Panel("{0,0,-1}")  # disabled
line_2 = LineSDL(Start=end_4.Start, Direction=panel_66, Length=multiplication_4)  # disabled
atan_2 = ArcTangent(Value=gravity_ds_ration_2)  # disabled
rotax_3 = RotateAxis(Geometry=line_2, Angle=atan_2, Axis=chord_dam_3)  # -> Geometry, Transform; disabled
swp1_5 = Sweep1(Rail=chord_dam_3, Sections=line_2, Miter=1)  # -> flatten(Brep); disabled
swp1_6 = Sweep1(Rail=chord_dam_3, Sections=rotax_3.Geometry, Miter=1)  # -> flatten(Brep); disabled
entwine_2 = Entwine(Branch00=swp1_5, Branch01=swp1_6, FlattenInputs=True)  # -> simplify(Result); disabled
bbx_2 = BrepBrep(BrepA=entwine_2, BrepB=brep_terrain_base_foundation_4)  # -> Curves, Points; disabled
geo_5 = Geometry(bbx_2.Curves)  # disabled
explode_3 = Explode(Curve=geo_5, Recursive=False)  # -> Segments, Vertices; disabled
pline_5 = PolyLine(Vertices=explode_3.Vertices, Closed=False)  # disabled
lng_4 = ListLength(List=explode_3.Vertices)  # disabled
number_slider_8 = Slider(0.2, range=0..1)  # disabled
smoothpline_2 = SmoothPolyline(Polyline=pline_5, Strength=number_slider_8, Times=lng_4)  # disabled
srfsplit_2 = SurfaceSplit(Surface=entwine_2, Curves=smoothpline_2)  # disabled
center_3 = Center(Geometric=srfsplit_2, referenceAll=2)  # -> Center, Dimension; disabled
sort_4 = SortList(Keys=center_3.Dimension, ValuesA=srfsplit_2)  # -> Keys, ValuesA; disabled
amp_2 = Amplitude(Vector=vector_waterflow_3, Amplitude=gravity_width_crest_2)  # disabled
pt_4 = Point(midpt_2)  # disabled
item_16 = ListItem(List=sort_4.ValuesA, Index=0, Wrap=True)  # -> simplify(Item); disabled
loft_2 = Loft(
    Curves=flatten(smoothpline_2),
    Options={Adjust=True, Closed=False, LoftEnds=0, LoftSimp=0, LoftType=5, Rebuild=10, Refit=0.01})  # disabled
simplify_2 = SimplifyTree(Tree=smoothpline_2, Front=False)  # disabled
move_4 = Move(Geometry=pt_4, Motion=amp_2)  # -> Geometry, Transform; disabled
panel_67 = Panel("{1}")  # disabled
join_6 = BrepJoin(Breps=flatten([loft_2, item_16]))  # -> Breps, Closed; disabled
branch_2 = TreeBranch(Tree=simplify_2, Path=panel_67, MaintainPaths=True)  # disabled
branch_3 = TreeBranch(Tree=item_16, Path=panel_67, MaintainPaths=True)  # disabled
panel_68 = Panel("0,0,-1")  # disabled
project_6 = ProjectPoint(Point=move_4.Geometry, Direction=panel_68, Geometry=flatten(branch_3))  # -> Point, Index; disabled
number_slider_9 = Slider(100, range=0..100)  # disabled
pline_6 = PolyLine(Vertices=flatten([pt_4, move_4.Geometry, project_6.Point]), Closed=True)  # disabled
move2pt_2 = MoveToPoint(Geometry=pline_6, PointA=pt_4, PointB=end_4.Start)  # -> Moved, Vector, Transform; disabled
Z_8 = UnitZ(Factor=number_slider_9)  # disabled
swp1_7 = Sweep1(Rail=chord_dam_3, Sections=move2pt_2.Moved, Miter=1)  # disabled
extr_2 = Extrude(Base=branch_2, Direction=Z_8)  # disabled
split_2 = SplitBrep(Brep=extr_2, Cutter=swp1_7)  # disabled
split_3 = SplitBrep(Brep=swp1_7, Cutter=extr_2)  # disabled
center_4 = Center(Geometric=split_2, referenceAll=2)  # -> Center, Dimension; disabled
center_5 = Center(Geometric=split_3, referenceAll=2)  # -> Center, Dimension; disabled
sort_5 = SortList(Keys=center_4.Dimension, ValuesA=split_2)  # -> Keys, reverse(ValuesA); disabled
sort_6 = SortList(Keys=center_5.Dimension, ValuesA=split_3)  # -> Keys, reverse(ValuesA); disabled
cull_i_5 = CullIndex(List=sort_5.ValuesA, Indices=0, Wrap=True)  # disabled
item_17 = ListItem(List=sort_6.ValuesA, Index=0, Wrap=True)  # disabled
join_7 = BrepJoin(Breps=flatten([cull_i_5, item_17]))  # -> Breps, Closed; disabled
sunion_2 = SolidUnion(Breps=[join_6.Breps, join_7.Breps])  # disabled
jagged_4 = SettingsSpeed()  # disabled
mesh_11 = MeshBrep(Brep=sunion_2, Settings=jagged_4)  # disabled
objfromgroup_5 = GetObjectsInGroup()

vector_waterflow_4 = RemoteReceiver(vector_waterflow)  # disabled
point_upstream_3 = RemoteReceiver(point_upstream)
hops_2 = Hops(
    BrepTerrain=brep_terrain_base_foundation_5,
    ChordDam=chord_dam_4,
    DSRatio=gravity_ds_ration_3,
    VectorWaterflow=vector_waterflow_4,
    WidthCrest=width_crest,
    CacheResultsInMemory=False,
    CacheSolveResults=False,
    RemoteDefinitionLocation="C:\Users\Admin\Documents\Github\EarlyStageDesign\JD\Skripts\Modules\Gravity.gh",
    RemoteSolveVersion=(0, 1, 0),
    ShowInput_Enabled=False,
    ShowInput_Path=True,
    SynchronousSolve=True)  # -> Geo, Volume; disabled

# ----
# Steps from the Technical Memorandum
#  No. EM36-86-68110
dam_7 = DataDam(
    DataChordToBaseFoundation=chord_dam_6,
    DataBaseFoundationTerrain=brep_terrain_base_foundation_6,
    DataPointUpstream=point_upstream_3,
    DataChord_dam=chord_dam_5,
    Terrain=brep_terrain_3,
    BufferDelay=10000000,
    BufferMode=1)  # -> DataChordToBaseFoundation, DataBaseFoundationTerrain, DataPointUpstream, DataChord_dam, DataTerrain
objfromgroup_6 = GetObjectsInGroup()

arch_dam_base_foundation_terrain = RemoteSender(dam_7.DataBaseFoundationTerrain)
arch_dam_original_terrain = RemoteSender(dam_7.DataTerrain)
chord_l1 = RemoteSender(dam_7.DataChord_dam)
chord_l1_2 = RemoteReceiver(chord_l1)
# 1. Determine L1 with section line
end_5 = EndPoints(Curve=chord_l1_2)  # -> Start, End
# On the formulas it is assumed here
# the lenght to excavated sound rock!
# Check technical memorandum. I have
#  changed the axis line to come from the
#  determined excavation on 06.06.23
dist = Distance(PointA=end_5.Start, PointB=end_5.End)
arch_l1 = RemoteSender(dist)
arch_l1_2 = RemoteReceiver(arch_l1)
arch_l1_3 = RemoteReceiver(arch_l1)
onoff = EnableDisableObject(Objects=objfromgroup_6, Enabled=equals_3.Equality, AllObjects_Object=dam_7)
arch_dam_base_foundation_terrain_2 = RemoteReceiver(arch_dam_base_foundation_terrain)
arch_dam_base_foundation_terrain_3 = RemoteReceiver(arch_dam_base_foundation_terrain)
volume_2 = MeshVolume(Mesh=mesh_10)  # -> Volume, Centroid
volume_3 = MeshVolume(Mesh=mesh_11)  # -> Volume, Centroid
onoff_2 = EnableDisableObject(
    Objects=objfromgroup_4,
    Enabled=equals_4.Equality,
    AllObjects_Object=[line, panel_63, end_3, rotax, atan, x_tremez, project_3, pdecon_3, pdecon_2, subtraction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])
onoff_3 = EnableDisableObject(
    Objects=objfromgroup_5,
    Enabled=equals_5.Equality,
    AllObjects_Object=[line_2, panel_66, end_4, rotax_3, atan_2, x_tremez_2, project_5, pdecon_5, pdecon_4, subtraction_2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])
gravity_volume = RemoteSender(volume_3.Volume)
geo_embankmentdam = RemoteSender(mesh_10)
geo_concretedam = RemoteSender(mesh_11)
embankment_volume = RemoteSender(volume_2.Volume)
round = Round(Number=volume_2.Volume)  # -> Nearest, Floor, Ceiling
format = Format(Format="{0:#0,000}", Culture=2055, Data0=volume_2.Volume)
round_2 = Round(Number=volume_3.Volume)  # -> Nearest, Floor, Ceiling
format_2 = Format(Format="{0:#0,000}", Culture=2055, Data0=volume_3.Volume)
panel_69 = Panel(round.Nearest)
panel_70 = Panel(format)
num_4 = Number(format_2)
panel_71 = Panel(round_2.Nearest)
panel_72 = Panel(format_2)
arch_dam_original_terrain_2 = RemoteReceiver(arch_dam_original_terrain)
arch_dam_base_foundation_terrain_4 = RemoteReceiver(arch_dam_base_foundation_terrain)
geo_embankmentdam_2 = RemoteReceiver(geo_embankmentdam)
geo_concretedam_2 = RemoteReceiver(geo_concretedam)
chord_l1_3 = RemoteReceiver(chord_l1)
roundd = RoundToDecimalPlace(NumberX=chord_l1_3, DecimalPlace=number_slider_4, RoundType=0)  # -> flatten(Rounded), Difference

# ----
# Preliminary layout of concrete arch dams (USBR)
# Topographic deiminesions necessary to
# compute thicknesses, projections, and
# volume are:
# - structural height (H)
# - horizontal distances between abutments;
#      - including estimated excavation to sound rock at crest elevation (L1)
#      - and 15 % of H above base (L2)
# Definitions: H = structural height
# Tc = thickness at crest
# Tb = thickness at base
# T_0.45H = thickness of crown cantilever at 0.45H above base (T0.45H)
# USP = upstream projection
# DSP = downestream projection
# L1 = straight line distance at crest elevation between abutmenets assumed excavated to sound rock
# L2 = straight line distance, at 0.15H above base, between abutments assumed excavated to sound rock
# V = estimated volume of dam
# Formulas - conservative as compared with values computed more precisely (in feet)
# at crest:
# at  base
# at 0.45H
arch_l1_4 = RemoteReceiver(arch_l1)
arch_l1_current_m = Panel(arch_l1_4)
panel_73 = Panel("USPcrest = 0.0")
panel_74 = Panel("DSPcrest = Tc")
# Technical Memorandum No. EM36-86-68110: 2.1.3.1 Single-, Two-, or Three- Centered Arch Dams
# 
# The number of lines-of-centers determines whether the arches are the same on the left and right side of the dam, are different on the left and right sides of the dam, or different on the inner and outer parts of the dam.
# 
# A single centered arch dam has a single line-of-centers that results in the same circular arcs from the left to the right abutment.
# 
# A 2-centered arch dam has two lines-of-centers that result in different circular arcs for the left side and right sides of the dam.
# 
# A 3-centered arch dam has two lines-of-centers that result in different circular arcs near the crown cantilever (inner) and near the abutments (outer). The radii for the inner arcs are shorter than the outer arcs.
# Technical Memorandum No. EM36-86-68110: 2.1.3.2 Uniform- or Variable Thickness Arch Dams
# 
# The number of lines that define the line-of-centers determines whether the arches are uniform thickness or variable thickness arches.
# The arches have uniform thickness if there is one line defining the extrados and intrados line-of-centers. This means that the radius center for the upstream and downstream faces is the same. The radii lengths are different at each elevation, but since the radius center is the same, the thickness of the arch is uniform.
# The arches vary in thickness if there are two lines defining the extrados and intrados line-of-centers. This means that the radius centers for the upstream and downstream faces are in different positions in space forcing the circular arcs of the arches to diverge.
panel_75 = Panel(" 1 foot = 0.3048 m")

expression = Expression(m=arch_l1_current_m, Expression="m*3.28084")

l1_feet = Panel(expression)
expression_2 = Expression(L1=l1_feet, Expression="0.6*L1")
r_axis_feet = Panel(expression_2)

expression_3 = Expression(ft=r_axis_feet, Expression="ft*0.3048")

r_axis_m = Panel(expression_3)
crest_radius = RemoteSender(r_axis_m)

crest_radius_2 = RemoteReceiver(crest_radius)
crest_radius_3 = RemoteReceiver(crest_radius)
# Technical Memorandum No. EM36-86-68110: 4.2 Determine an Appraisal Level Arch Dam Layout
# 
# 3 - If the topography map is of the ground surface, change the contours to represent the position of sound rock.
crest_radius_4 = RemoteReceiver(crest_radius)

# ----
# Technical Memorandum No. EM36-86-68110: 4.2 Determine an Appraisal Level Arch Dam Layout
# 
# 2 - Determine Raxis= 0.6 L1 and round the value of Raxis up to the nearest 10 to 50 feet.
# This is the initial layout, so no need for decimal accuracy
r_crest_usp = Panel(crest_radius_4)

# ----
# 2. Determine radius according to L1
addition_2 = Addition(A=r_crest_usp, B=raxis_adjustments)

# ----
# 3. Create crest curve
end_6 = EndPoints(Curve=dam_7.DataChordToBaseFoundation)  # -> Start, End
cir = Circle(Plane=end_6.Start, Radius=addition_2)
cir_2 = Circle(Plane=end_6.End, Radius=addition_2)
ccx = CurveCurve(CurveA=cir, CurveB=cir_2)  # -> Points, ParamsA, ParamsB
dist_2 = Distance(PointA=ccx.Points, PointB=dam_7.DataPointUpstream)
sort_7 = SortList(Keys=dist_2, ValuesA=ccx.Points)  # -> reverse(Keys), reverse(ValuesA)
item_18 = ListItem(List=sort_7.ValuesA, Index=0, Wrap=True)  # -> Item, Item1
circle = CircleCNR(Center=item_18.Item, Normal=Vector(0, 0, 1), Radius=addition_2)
ln_3 = Line(StartPoint=item_18.Item, EndPoint=item_18.Item1)
ccx_2 = CurveCurve(CurveA=dam_7.DataChordToBaseFoundation, CurveB=circle)  # -> Points, ParamsA, ParamsB
shatter = Shatter(Curve=circle, Parameters=ccx_2.ParamsB)
colom = CollisionOneMany(Collider=ln_3, Obstacles=shatter)  # -> Collision, Index
item_19 = ListItem(List=shatter, Index=colom.Index, Wrap=True)

# ---- group: Axis arch Dam
# Technical Memorandum No. EM36-86-68110: 4.2 Determine an Appraisal Level Arch Dam Layout
# 
# 4 - Position the dam in the canyon. Draw a circular arc with radius Raxis...This arc is the axis of the dam and is the upstream side of the crest. Move the axis around the propose dam location to
# position the top of the dam in the canyon.
# 
# The angle of incidence of the axis into the left and right abutments should be approximately equal to produce a geometrically symmetric dam in the canyon.
geo_6 = Geometry(item_19)

# ----
usp_arch_crest = RemoteSender(geo_6)
usp_arch_crest_2 = RemoteReceiver(usp_arch_crest)
usp_arch_crest_3 = RemoteReceiver(usp_arch_crest)
usp_arch_crest_4 = RemoteReceiver(flatten(usp_arch_crest))
path_mapper_2 = PathMapper(usp_arch_crest_4, source="{A}", target="{0;A}")
usp_arch_crest_5 = RemoteReceiver(usp_arch_crest)
geo_7 = Geometry(usp_arch_crest_5)
len_5 = Length(Curve=geo_7)
roundd_2 = RoundToDecimalPlace(NumberX=geo_7, DecimalPlace=number_slider_4, RoundType=0)  # -> flatten(Rounded), Difference
usp_arch_crest_6 = RemoteReceiver(usp_arch_crest)  # disabled
len_6 = Length(Curve=usp_arch_crest_6)  # disabled

# ---- group: Lowest point (Base - middle section)
project_7 = Project(Curve=usp_arch_crest_2, Brep=arch_dam_base_foundation_terrain_3, Direction=Vector(0, 0, 1))

# ----
eval = EvaluateCurve(Curve=reparameterize(project_7), Parameter=Slider(0.48, range=0..1))  # -> Point, Tangent, Angle

# ----
# 4. Figure L2
darc = DeconstructArc(Arc=usp_arch_crest_2)  # -> flatten(BasePlane), Radius, Angle
x_tremez_3 = Extremes(Curve=project_7, Plane=PlaneXY(0, 0, 0))  # -> Highest, Lowest

# ---- group: Lowest point (Base - middle section) (continued)
point_foot_dam = Point(x_tremez_3.Lowest)

# ----
point_at_base = RemoteSender(point_foot_dam)
point_at_base_2 = RemoteReceiver(point_at_base)

# ----
# Technical Memorandum No. EM36-86-68110: 4.2 Determine an Appraisal Level Arch Dam Layout
# 
# 5 - On the axis, locate a point about midway between the abutments and in the riverbed. This is the location of the crown cantilever...
project_8 = Project(Geometry=point_foot_dam, Plane=darc.BasePlane)  # -> Geometry, Transform
ln_4 = Line(StartPoint=point_foot_dam, EndPoint=project_8.Geometry)
eval_2 = EvaluateCurve(Height=reparameterize(ln_4), Point_at_015H="0.15")  # -> Point, Tangent, Angle
len_7 = Length(Curve=ln_4)

# ---- group: Centrifugal vector
pt_5 = Point(darc.BasePlane)
pt_6 = Point(project_8.Geometry)
vec2pt_2 = Vector2Pt(PointA=pt_6, PointB=pt_5, Unitize=True)  # -> Vector, Length

# ----
vec2pt_3 = Vector2Pt(PointA=pt_6, PointB=eval_2.Point, Unitize=False)  # -> Vector, Length
move_5 = Move(Geometry=usp_arch_crest_2, Motion=vec2pt_3.Vector)  # -> Geometry, Transform
bcx = BrepCurve(Brep=arch_dam_base_foundation_terrain_3, Curve=move_5.Geometry)  # -> Curves, flatten(Points)
crv_cp_2 = CurveClosestPoint(Point=bcx.Points, Curve=move_5.Geometry)  # -> Point, Parameter, Distance
shatter_2 = Shatter(Curve=move_5.Geometry, Parameters=crv_cp_2.Parameter)
colom_2 = CollisionOneMany(Collider=eval_2.Point, Obstacles=shatter_2)  # -> Collision, Index
item_20 = ListItem(List=shatter_2, Index=colom_2.Index, Wrap=True)
end_7 = EndPoints(Curve=item_20)  # -> Start, End
dist_3 = Distance(PointA=end_7.Start, PointB=end_7.End)

# ----
# Technical Memorandum No. EM36-86-68110: 4.2 Determine an Appraisal Level Arch Dam Layout
# 
# 5 - ...The radius of the axis at this point is the orientation of the reference plane and the line of centers. The reference plane is a vertical plane through the crown cantilever and generally parallel to the stream bank.
ln_5 = Line(StartPoint=pt_6, EndPoint=pt_5)

project_9 = Project(Geometry=ln_5, Plane=point_foot_dam)  # -> Geometry, Transform

rulesrf = RuledSurface(CurveA=project_9.Geometry, CurveB=ln_5)
srf = Surface(rulesrf)
evalsrf = EvaluateSurface(Surface=reparameterize(srf), Point="0.5,0.5")  # -> Point, Normal, UDirection, VDirection, Frame
pl = PlaneNormal(Origin=evalsrf.Point, ZAxis=evalsrf.Normal)
crv_2 = Curve(rulesrf)

ext = ExtendCurve(Curve=project_9.Geometry, Type=0, Start=500, End=500)
crv_3 = Curve(ext)
point_crest = RemoteSender(project_8.Geometry)
# Elevation here!
reference_centers_outline = RemoteSender(crv_2)
abiscissa_dam_axis = RemoteSender(crv_3)
center_crest = RemoteSender(pt_5)
arch_l2 = RemoteSender(dist_3)
refecenre_centers_vector = RemoteSender(evalsrf.Normal)
centrifugal_vector = RemoteSender(vec2pt_2.Vector)
reference_centers_plane = RemoteSender(pl)
arch_dam_height = RemoteSender(len_7)
arch_dam_height_2 = RemoteReceiver(arch_dam_height)
arch_dam_height_3 = RemoteReceiver(arch_dam_height)
point_crest_2 = RemoteReceiver(point_crest)
centrifugal_vector_2 = RemoteReceiver(centrifugal_vector)

# ----
# x. Elevations
# Technical Memorandum No. EM36-86-68110: 4.2 Determine an Appraisal Level Arch Dam Layout
# 
# 9. Select 6 to 8 arch elevations on the crown cantilever to define the 3D dam. Select the lowest arch elevation starting at about 15% H. Then between 15% H and the crest, try to select 6 to 8 arches evenly spaced vertically and rounded to nearest contour elevation.
# E. Goulas: According to the Engineer Manual [1], the dam is divided into 5 to 10 evenly spaced horizontal arches and their respective parabolas are computed. They should be spaced not less than 3.048 meters (10 feet) nor more than 30.48 meters (100 feet) apart. The lowest parabola should be 0.15H to 0.20H above the base.
# DESIGN MANUAL FOR CONCRETE ARCH DAMS, 1977: Usually 5 to 10 arch elevations are selected such that the  entire dam is represented by a system of horizontal elements evenly spaced over the
# height of the structure.
# Usually the intervals are not greater than 100 (30.5m) feet nor less than 20 feet (6.1m).
# Technical Memorandum No. EM36-86-68110: Select the lowest arch elevation starting at about 15% H. Then between 15% H and the crest, try to select 6 to 8 arches evenly spaced vertically and rounded to nearest contour
# elevation. Even spacing arches permit best evaluation of the ADSAS results.
# EM_1110-2-2201_ARCH_DAM_DESIGN: The
# lowest arch should be 0.15H to 0.20H above the base of the crown cantilever.
section_height_approx = Slider(11, range=6..30)
eval_3 = EvaluateCurve(Height=reparameterize(ln_4), Point_at_015H="0.2")  # -> Point, Tangent, Angle
shatter_3 = Shatter(Curve=reparameterize(ln_4), Parameters="0.2")
item_21 = ListItem(List=shatter_3, Index="1", Wrap=True)
len_8 = Length(Curve=item_21)
expression_4 = Expression(section_heights=section_height_approx, height=len_8, Expression="height/section_heights")
eval_4 = EvaluateCurve(Height=reparameterize(ln_4), PointAt0="0")  # -> Point, Tangent, Angle
round_3 = Round(Number=expression_4)  # -> Nearest, Floor, Ceiling
divide = DivideCurve(Curve=item_21, Count=round_3.Nearest, Kinks=False)  # -> Points, Tangents, Parameters
division_2 = Division(A=len_8, B=round_3.Nearest)  # -> flatten(Result)
pt_7 = Point(flatten([divide.Points, eval_4.Point]))
pdecon_6 = Deconstruct(Point=pt_7)  # -> XComponent, YComponent, ZComponent
section_height_actual = Panel(division_2)
sort_8 = SortList(Keys=pdecon_6.ZComponent, ValuesA=pt_7)  # -> reverse(Keys), reverse(ValuesA)
cull_i_6 = CullIndex(List=sort_8.ValuesA, Indices=0, Wrap=True)
pln_3 = Plane(simplify(graft(cull_i_6)))

item_22 = ListItem(List=sort_8.ValuesA, Index=0, Wrap=True)
pln_4 = Plane(simplify(graft(item_22)))
crest_plane_elevation = RemoteSender(pln_4)
plane_elevations = RemoteSender(pln_3)
plane_elevations_2 = RemoteReceiver(plane_elevations)
plane_elevations_3 = RemoteReceiver(plane_elevations)
refecenre_centers_vector_2 = RemoteReceiver(refecenre_centers_vector)
reference_centers_plane_2 = RemoteReceiver(reference_centers_plane)
center_crest_2 = RemoteReceiver(center_crest)
refecenre_centers_vector_3 = RemoteReceiver(refecenre_centers_vector)
reference_centers_plane_3 = RemoteReceiver(reference_centers_plane)
plane_elevations_4 = RemoteReceiver(plane_elevations)
arch_dam_height_4 = RemoteReceiver(arch_dam_height)
arch_dam_height_5 = RemoteReceiver(arch_dam_height)
expression_5 = Expression(L=len_5, H=arch_dam_height_5, Expression="L/H")
roundd_3 = RoundToDecimalPlace(NumberX=arch_dam_height_4, DecimalPlace=number_slider_4, RoundType=0)  # -> flatten(Rounded), Difference
roundd_4 = RoundToDecimalPlace(NumberX=expression_5, DecimalPlace=number_slider_4, RoundType=0)  # -> flatten(Rounded), Difference
arch_dam_height_6 = RemoteReceiver(arch_dam_height)  # disabled
arch_dam_height_7 = RemoteReceiver(arch_dam_height)  # disabled

arch_dam_height_8 = RemoteReceiver(arch_dam_height)
# Do concrete formula estimation to check
# how different they are from the volume in gh
# check memoradum
arch_l2_2 = RemoteReceiver(arch_l2)
arch_l2_current_m = Panel(arch_l2_2)
meter = Panel(arch_dam_height_8)

expression_6 = Expression(m=meter, Expression="m*3.28084")
expression_7 = Expression(m=arch_l2_current_m, Expression="m*3.28084")

l2_feet = Panel(expression_7)
feet = Panel(expression_6)
expression_8 = Expression(H=feet, L1=l1_feet, L2=l2_feet, Expression="(0.0012*H*L1*L2*((H/400)^(H/400)))^(⅓)")
expression_9 = Expression(Tb=expression_8, Expression="0.67*Tb")
expression_10 = Expression(Tb=expression_8, Expression="0.33*Tb")
expression_11 = Expression(Tb=expression_8, Expression="0.95*Tb")
expression_12 = Expression(H=feet, L1=l1_feet, Expression="0.01*(H + 1.2*L1)")
expression_13 = Expression(H=feet, L1=l1_feet, L2=l2_feet, Expression="0.000002*(H²)*L2*(((H+0.8*L1)²)/(L1-L2))+0.0004*H*L1*(H+1.1*L1)")
tc_feet = Panel(expression_12)
usp_base_feet = Panel(expression_9)
dsp_base_feet = Panel(expression_10)
tb_0_45h_feet = Panel(expression_11)

expression_14 = Expression(ft=usp_base_feet, Expression="ft*0.3048")
expression_15 = Expression(ft=tc_feet, Expression="ft*0.3048")
expression_16 = Expression(ft=dsp_base_feet, Expression="ft*0.3048")
expression_17 = Expression(ft=tb_0_45h_feet, Expression="ft*0.3048")

usp_base_m = Panel(expression_14)
dsp_base_m = Panel(expression_16)
tb_0_45h_m = Panel(expression_17)
tc_m = Panel(expression_15)
arch_usp_at_045h = RemoteSender(tb_0_45h_m)
arch_usp_base = RemoteSender(usp_base_m)
arch_dsp_base = RemoteSender(dsp_base_m)
arch_tc = RemoteSender(tc_m)

arch_usp_base_2 = RemoteReceiver(arch_usp_base)
arch_usp_at_045h_2 = RemoteReceiver(arch_usp_at_045h)
arch_usp_base_3 = RemoteReceiver(arch_usp_base)
arch_dsp_base_2 = RemoteReceiver(arch_dsp_base)
arch_tc_2 = RemoteReceiver(arch_tc)
arch_tc_3 = RemoteReceiver(arch_tc)
arch_usp_at_045h_3 = RemoteReceiver(arch_usp_at_045h)
arch_usp_base_4 = RemoteReceiver(arch_usp_base)
arch_dsp_base_3 = RemoteReceiver(arch_dsp_base)
format_3 = Format(
    Format=panel_27,
    Culture=127,
    Data0=crest_radius_2,
    Data1=arch_l1_2,
    Data2=arch_tc_2,
    Data3=arch_dam_height_2,
    Data4=arch_usp_base_3,
    Data5=arch_dsp_base_2,
    Data6=arch_usp_at_045h_2,
    Data7=expression_13,
    Data8=raxis_adjustments,
    Data9=addition_2,
    Data10=freeboard_2,
    Data11=offset_foundation_2)
format_4 = Format(
    Format=panel_29,
    Culture=127,
    Data0=crest_radius_3,
    Data1=arch_l1_3,
    Data2=arch_tc_3,
    Data3=arch_dam_height_3,
    Data4=arch_usp_base_4,
    Data5=arch_dsp_base_3,
    Data6=arch_usp_at_045h_3,
    Data7=expression_13,
    Data8=raxis_adjustments,
    Data9=addition_2,
    Data10=freeboard_3,
    Data11=offset_foundation_3)
panel_76 = Panel(format_3)
panel_77 = Panel(format_4)
assumptions = RemoteSender(panel_77)
arch_tc_4 = RemoteReceiver(arch_tc)
subtraction_3 = Subtraction(A=addition_2, B=arch_tc_4)
r_crest_dsp = Panel(subtraction_3)
cir_3 = Circle(Plane=item_18.Item, Radius=r_crest_dsp)
scx_3 = SurfaceCurve(Surface=arch_dam_base_foundation_terrain_2, Curve=cir_3)  # -> Curves, Points, UVPoints, Normals, Parameters, Tangents
shatter_4 = Shatter(Curve=cir_3, Parameters=scx_3.Parameters)
colom_3 = CollisionOneMany(Collider=ln_3, Obstacles=shatter_4)  # -> Collision, Index
item_23 = ListItem(List=shatter_4, Index=colom_3.Index, Wrap=True)
dsp_arch_crest = RemoteSender(item_23)
arch_usp_at_045h_4 = RemoteReceiver(arch_usp_at_045h)
arch_usp_base_5 = RemoteReceiver(arch_usp_base)
arch_dsp_base_4 = RemoteReceiver(arch_dsp_base)
arch_tc_5 = RemoteReceiver(arch_tc)

# ---- group: Crown Cantilever
# 5. Section points - based on the equations
# At Base
# At Crest:
# At 0.45H
panel_78 = Panel("0.45")
eval_5 = EvaluateCurve(Height=reparameterize(ln_4), Point_at_045H=panel_78)  # -> Point, Tangent, Angle
neg_3 = Negative(Value=centrifugal_vector_2)
neg_4 = Negative(Value=centrifugal_vector_2)
amp_3 = Amplitude(Vector=centrifugal_vector_2, Amplitude=arch_tc_5)
amp_4 = Amplitude(Vector=neg_4, Amplitude=arch_usp_base_5)
amp_5 = Amplitude(Vector=neg_3, Amplitude=arch_usp_at_045h_4)
amp_6 = Amplitude(Vector=centrifugal_vector_2, Amplitude=arch_dsp_base_4)
move_6 = Move(Geometry=point_at_base_2, Motion=amp_6)  # -> Geometry, Transform
move_7 = Move(Geometry=point_at_base_2, Motion=amp_4)  # -> Geometry, Transform
move_8 = Move(Geometry=point_crest_2, Motion=amp_3)  # -> Geometry, Transform
move_9 = Move(Geometry=eval_5.Point, Motion=amp_5)  # -> Geometry, Transform
usp_pt_at_base = Point(move_7.Geometry)
pt_at_0_45h = Point(move_9.Geometry)
pt_at_crest = Point(point_crest_2)
pt_at_0_45h_2 = Point(eval_5.Point)
pt_at_crest_2 = Point(move_8.Geometry)
pt_at_base = Point(move_6.Geometry)
# Technical Memorandum No. EM36-86-68110: 4.2 Determine an Appraisal Level Arch Dam Layout
# 
# 7 - Determine the geometry of the upstream and downstream face along the crown cantilever. A circle can be drawn through the 3 points computed for the upstream face in Step 6. Likewise, a circle can be drawn through the 3 points computed for the
# downstream face.
# 
# 8. Draw the upstream and downstream face along the crown cantilever.
arc = Arc3Pt(PointA=pt_at_crest_2, PointB=pt_at_0_45h_2, PointC=pt_at_base)  # -> DownstreamArc, CenterP, RadiusM
arc_2 = Arc3Pt(PointA=pt_at_crest, PointB=pt_at_0_45h, PointC=usp_pt_at_base)  # -> UpstreamArc, CenterP, RadiusM
ds_arc = RemoteSender(arc.DownstreamArc)
us_arc = RemoteSender(arc_2.UpstreamArc)

# ----
ln_6 = Line(StartPoint=point_crest_2, EndPoint=move_8.Geometry)
ln_7 = Line(StartPoint=move_6.Geometry, EndPoint=move_7.Geometry)
ln_8 = Line(StartPoint=eval_5.Point, EndPoint=move_9.Geometry)
len_9 = Length(Curve=ln_6)
len_10 = Length(Curve=ln_7)
len_11 = Length(Curve=ln_8)
roundd_5 = RoundToDecimalPlace(NumberX=len_9, DecimalPlace=Slider(1, range=0..1), RoundType=0)  # -> flatten(Rounded), Difference
# Technical Memorandum No. EM36-86-68110: 4.2 Determine an Appraisal Level Arch Dam Layout
# 
# 6 - Determine the shape of the crown cantilever. From the equations provided,
# compute TC, TB, T0.45H, USPC, USP0.45H, USPB, DSPC, DSP0.45H, and DSPB.
roundd_6 = RoundToDecimalPlace(NumberX=len_11, DecimalPlace=Slider(1, range=0..1), RoundType=0)  # -> flatten(Rounded), Difference
roundd_7 = RoundToDecimalPlace(NumberX=len_10, DecimalPlace=Slider(1, range=0..1), RoundType=0)  # -> flatten(Rounded), Difference
width_0_45 = RemoteSender(roundd_6.Rounded)
width_base = RemoteSender(roundd_7.Rounded)
width_crest_2 = RemoteSender(roundd_5.Rounded)
ds_arc_2 = RemoteReceiver(ds_arc)
bcx_2 = BrepCurve(Brep=arch_dam_original_terrain_2, Curve=ds_arc_2)  # -> Curves, Points
point_foot_arch_dam = RemoteSender(bcx_2.Points)
dsp_arch_crest_2 = RemoteReceiver(dsp_arch_crest)
ds_arc_3 = RemoteReceiver(ds_arc)
us_arc_2 = RemoteReceiver(us_arc)

# ----
# x. Dam Footprint
# original projection to foundation
end_8 = EndPoints(Curve=ds_arc_3)  # -> Start, End
end_9 = EndPoints(Curve=us_arc_2)  # -> Start, End
dsp_point_bottom_foundation = Point(end_8.End)
usp_point_bottom_foundation = Point(end_9.End)
end_10 = EndPoints(Curve=usp_arch_crest_3)  # -> Start, End
end_11 = EndPoints(Curve=dsp_arch_crest_2)  # -> Start, End
project_10 = Project(Geometry=dsp_point_bottom_foundation, Plane=end_11.Start)  # -> Geometry, Transform
project_11 = Project(Geometry=usp_point_bottom_foundation, Plane=end_10.Start)  # -> Geometry, Transform
arc_3 = Arc3Pt(PointA=end_11.Start, PointB=project_10.Geometry, PointC=end_11.End)  # -> UpstreamArc, CenterP, RadiusM
arc_4 = Arc3Pt(PointA=end_10.Start, PointB=project_11.Geometry, PointC=end_10.End)  # -> UpstreamArc, CenterP, RadiusM
project_12 = Project(Curve=arc_4.UpstreamArc, Brep=arch_dam_base_foundation_terrain_4, Direction=Vector(0, 0, 1))
project_13 = Project(Curve=arc_3.UpstreamArc, Brep=arch_dam_base_foundation_terrain_4, Direction=Vector(0, 0, 1))
explode_4 = Explode(Curve=project_12, Recursive=False)  # -> Segments, Vertices
explode_5 = Explode(Curve=project_13, Recursive=False)  # -> Segments, Vertices
pline_7 = PolyLine(Vertices=explode_4.Vertices, Closed=False)
pline_8 = PolyLine(Vertices=explode_5.Vertices, Closed=False)
lng_5 = ListLength(List=explode_4.Vertices)
lng_6 = ListLength(List=explode_5.Vertices)
smoothpline_3 = SmoothPolyline(Polyline=pline_7, Strength=Slider(0.5, range=0..1), Times=lng_5)
smoothpline_4 = SmoothPolyline(Polyline=pline_8, Strength=Slider(0.5, range=0..1), Times=lng_6)
usp_footprint = Curve(smoothpline_3)
dsp_footprint = Curve(smoothpline_4)

usp_prefootprint = RemoteSender(usp_footprint)
dsp_prefootprint = RemoteSender(dsp_footprint)
usp_prefootprint_2 = RemoteReceiver(usp_prefootprint)
dsp_prefootprint_2 = RemoteReceiver(dsp_prefootprint)
us_arc_3 = RemoteReceiver(us_arc)
ds_arc_4 = RemoteReceiver(ds_arc)
# building arches at each level
us_arc_4 = RemoteReceiver(us_arc)
ds_arc_5 = RemoteReceiver(ds_arc)
pcx = CurvePlane(DownstreamArc=ds_arc_5, Plane=plane_elevations_4)  # -> simplify(Points), ParamsC, ParamsP
# Technical Memorandum No. EM36-86-68110: 4.2 Determine an Appraisal Level Arch Dam Layout
# 
# 10. On the topography map, draw the upstream and downstream projections of the crown cantilever and downstream arc at the crest on the reference plane. Using the same radius center as the axis, draw the circular arc for the downstream side of the crest using the radius (Raxis – Tc). On the reference plane draw points at each arch elevation on the upstream and downstream faces.
pcx_2 = CurvePlane(UpstreamArc=us_arc_4, Plane=plane_elevations_4)  # -> simplify(Points), ParamsC, ParamsP
us_ds_slices_intersections = RemoteSender([pcx_2.Points, pcx.Points])
dsp_arch_crest_3 = RemoteReceiver(flatten(dsp_arch_crest))
path_mapper_3 = PathMapper(dsp_arch_crest_3, source="{A}", target="{1;A}")
point_foot_arch_dam_2 = RemoteReceiver(point_foot_arch_dam)
pdecon_7 = Deconstruct(Point=point_foot_arch_dam_2)  # -> XComponent, YComponent, ZComponent
roundd_8 = RoundToDecimalPlace(NumberX=pdecon_7.ZComponent, DecimalPlace=number_slider_4, RoundType=0)  # -> flatten(Rounded), Difference
width_crest_3 = RemoteReceiver(width_crest_2)
width_base_2 = RemoteReceiver(width_base)
width_0_45_2 = RemoteReceiver(width_0_45)
usp_prefootprint_3 = RemoteReceiver(usp_prefootprint)  # disabled
dsp_prefootprint_3 = RemoteReceiver(dsp_prefootprint)  # disabled
dam_pre_footprint = Curve([usp_prefootprint_3, dsp_prefootprint_3])  # disabled
assumptions_2 = RemoteReceiver(assumptions)  # disabled
split_4 = TextSplit(Text=flatten(assumptions_2), Separators=panel_49)  # disabled
dispatch_8 = Dispatch(List=split_4, DispatchPattern=[True, False])  # -> flatten(ListA), flatten(ListB); disabled
trim = TextTrim(Text=dispatch_8.ListB, Start=True, End=True)  # disabled
merge_12 = Merge(Data1=panel_48, Data2=dispatch_8.ListA)  # disabled
join_8 = TextJoin(Text=merge_12, Join=panel_52)  # disabled
panel_79 = Panel(merge_12)  # disabled

dam_8 = DataDam(DataA=merge_10, BufferDelay=10000000, BufferMode=1)

# ----
# Technical Memorandum No. EM36-86-68110: 4.2 Determine an Appraisal Level Arch Dam Layout
# 
# 12.a. Draw the upstream face arch starting with the first arch below the crest. Use an initial guess for the line of centers as a 0.2:1 sloping line.
# x. Line of centers
flatten = FlattenTree(Tree=plane_elevations_2, Path="{0}")
flatten_2 = FlattenTree(Tree=plane_elevations_3, Path="{0}")
cull_i_7 = CullIndex(List=flatten, Indices=-1, Wrap=True)  # -> simplify(graft(List))
cull_i_8 = CullIndex(List=flatten_2, Indices=-1, Wrap=True)  # -> simplify(graft(List))
pcx_3 = CurvePlane(DownstreamArc=ds_arc_4, Plane=cull_i_8)  # -> simplify(Points), ParamsC, ParamsP
pcx_4 = CurvePlane(DSPFootprint=dsp_prefootprint_2, Plane=cull_i_8)  # -> simplify(Points), ParamsC, ParamsP
pcx_5 = CurvePlane(USPFootprint=usp_prefootprint_2, Plane=cull_i_7)  # -> simplify(Points), ParamsC, ParamsP
pcx_6 = CurvePlane(UpstreamArc=us_arc_3, Plane=cull_i_7)  # -> simplify(Points), ParamsC, ParamsP
item_24 = ListItem(List=pcx_4.Points, Index=0, Wrap=True)  # -> Item, Item1
arc_5 = Arc3Pt(PointA=item_24.Item, PointB=pcx_3.Points, PointC=item_24.Item1)  # -> Arc, Plane, Radius
darc_2 = DeconstructArc(Arc=arc_5.Arc)  # -> BasePlane, Radius, Angle
rev = Reverse(Vector=refecenre_centers_vector_3)
project_14 = ProjectPoint(Point=darc_2.BasePlane, Direction=[refecenre_centers_vector_3, rev], Geometry=reference_centers_plane_3)  # -> Point, Index
rev_2 = Reverse(Vector=refecenre_centers_vector_2)
clean_5 = CleanTree(RemoveNulls=True, RemoveInvalid=True, RemoveEmpty=False, Tree=project_14.Point)  # -> flatten(Tree)
center_at_crest = Point(center_crest_2)
abiscissa_dam_axis_2 = RemoteReceiver(abiscissa_dam_axis)

item_25 = ListItem(List=pcx_5.Points, Index=0, Wrap=True)  # -> Item, Item1

arc_6 = Arc3Pt(PointA=item_25.Item, PointB=pcx_6.Points, PointC=item_25.Item1)  # -> Arc, Plane, Radius
darc_3 = DeconstructArc(Arc=arc_6.Arc)  # -> BasePlane, Radius, Angle
project_15 = ProjectPoint(Point=darc_3.BasePlane, Direction=[refecenre_centers_vector_2, rev_2], Geometry=reference_centers_plane_2)  # -> Point, Index
clean_6 = CleanTree(RemoveNulls=True, RemoveInvalid=True, RemoveEmpty=False, Tree=project_15.Point)  # -> flatten(Tree)

centers_extrados_not_normalized = Point([center_at_crest, clean_6])
pline_9 = PolyLine(Vertices=centers_extrados_not_normalized, Closed=False)
lng_7 = ListLength(List=centers_extrados_not_normalized)
smoothpline_5 = SmoothPolyline(Polyline=pline_9, Strength=1, Times=lng_7)
ext_2 = ExtendCurve(Curve=smoothpline_5, Type=2, Start=0, End=500)
ccx_3 = CurveCurve(CurveA=ext_2, CurveB=abiscissa_dam_axis_2)  # -> Points, ParamsA, ParamsB
shatter_5 = Shatter(Curve=ext_2, Parameters=flatten(ccx_3.ParamsA))
sort_9 = SortList(Keys=shatter_5, ValuesA=shatter_5)  # -> Keys, ValuesA
item_26 = ListItem(List=sort_9.ValuesA, Index=0, Wrap=True)
geo_8 = Geometry(item_26)

centers_extrados_not_normalized_2 = Point([center_at_crest, clean_5])
pline_10 = PolyLine(Vertices=centers_extrados_not_normalized_2, Closed=False)
lng_8 = ListLength(List=centers_extrados_not_normalized_2)
smoothpline_6 = SmoothPolyline(Polyline=pline_10, Strength=1, Times=lng_8)
ext_3 = ExtendCurve(Curve=smoothpline_6, Type=2, Start=0, End=500)
ccx_4 = CurveCurve(CurveA=ext_3, CurveB=abiscissa_dam_axis_2)  # -> Points, ParamsA, ParamsB
shatter_6 = Shatter(Curve=ext_3, Parameters=flatten(ccx_4.ParamsA))
sort_10 = SortList(Keys=shatter_6, ValuesA=shatter_6)  # -> Keys, ValuesA
item_27 = ListItem(List=sort_10.ValuesA, Index=0, Wrap=True)
geo_9 = Geometry(item_27)

line_of_centers_intrados = RemoteSender(geo_8)
line_of_centers_extrados = RemoteSender(geo_9)
line_of_centers_extrados_2 = RemoteReceiver(line_of_centers_extrados)
line_of_centers_intrados_2 = RemoteReceiver(line_of_centers_intrados)
pcx_7 = CurvePlane(LineOfCentersIntrados=line_of_centers_intrados_2, Plane=plane_elevations_4)  # -> simplify(CenterPoints), ParamsC, ParamsP
pcx_8 = CurvePlane(LineOfCentersExtrados=line_of_centers_extrados_2, Plane=plane_elevations_4)  # -> simplify(CenterPoints), ParamsC, ParamsP
ln_9 = Line(StartPoint=pcx.Points, EndPoint=pcx_7.CenterPoints)
ln_10 = Line(StartPoint=pcx_2.Points, EndPoint=pcx_8.CenterPoints)
len_12 = Length(Curve=ln_9)
len_13 = Length(Curve=ln_10)
cir_4 = Circle(DSCenters=pcx_7.CenterPoints, Radius=len_12)  # -> simplify(Circle)
cir_5 = Circle(USCenters=pcx_8.CenterPoints, Radius=len_13)
points_lineofcenters = RemoteSender([pcx_8.CenterPoints, pcx_7.CenterPoints])
path_mapper_4 = PathMapper(ln_10, source="{A}", target="{0;A}")
path_mapper_5 = PathMapper(cir_4, source="{A}", target="{1;A}")
path_mapper_6 = PathMapper(cir_5, source="{A}", target="{0;A}")
path_mapper_7 = PathMapper(ln_9, source="{A}", target="{1;A}")

# ---- group: Finding the intersection with sound rock
arch_dam_base_foundation_terrain_5 = RemoteReceiver(arch_dam_base_foundation_terrain)
relay = Relay([path_mapper_6, path_mapper_5])
relay_2 = Relay([path_mapper_4, path_mapper_7])
scx_4 = SurfaceCurve(Surface=arch_dam_base_foundation_terrain_5, Curve=relay)  # -> Curves, simplify(Points), UVPoints, Normals, Parameters, Tangents

# ---- group: Filter away last circle - touching sound rock
geo_10 = Geometry(relay)
tstat_2 = TreeStatistics(Tree=geo_10)  # -> Paths, Length, Count
division_3 = Division(A=tstat_2.Count, B="2")
x_minus_one_2 = XMinusOne(NumberX=division_3)
item_28 = ListItem(List=tstat_2.Paths, Index=flatten(["-1", x_minus_one_2]), Wrap=True)
split_5 = SplitTree(Data=geo_10, Masks=flatten(item_28))  # -> Positive, Negative
geo_11 = Geometry(split_5.Positive)

# ---- group: Adjusting the bottom so there is something to connect with the bottom circle
number_slider_10 = Slider(1, range=0..10)
centrifugal_vector_3 = RemoteReceiver(centrifugal_vector)
neg_5 = Negative(Value=number_slider_10)
rev_3 = Reverse(Vector=centrifugal_vector_3)
rad = Radians(Degrees=[number_slider_10, neg_5])
rotate = Rotate(Geometry=rev_3, Angle=rad, Plane=PlaneXY(0, 0, 0))  # -> flatten(Geometry), Transform
center_6 = Center(Geometric=geo_11)  # -> Center, Dimension
darc_4 = DeconstructArc(Arc=geo_11)  # -> BasePlane, Radius, Angle
line_3 = LineSDL(Start=center_6.Center, Direction=rotate.Geometry, Length=darc_4.Radius)
ccx_5 = CurveCurve(CurveA=geo_11, CurveB=line_3)  # -> Points, ParamsA, ParamsB
pshift = ShiftPaths(Data=ccx_5.ParamsA, Offset="-1")
shatter_7 = Shatter(Curve=geo_11, Parameters=pshift)
pshift_2 = ShiftPaths(Data=shatter_7, Offset="-1")

# ---- group: Cutting and selecting curves for dam
shatter_8 = Shatter(Curve=relay, Parameters=scx_4.Parameters)  # -> simplify(Segments)
colom_4 = CollisionOneMany(Collider=shatter_8, Obstacles=relay_2)  # -> Collision, Index
dispatch_9 = Dispatch(List=shatter_8, DispatchPattern=colom_4.Collision)  # -> ListA, ListB

# ----
split_6 = SplitTree(Data=dispatch_9.ListA, Masks=flatten(item_28))  # -> Positive, Negative

geo_12 = Geometry(split_6.Negative)
item_29 = ListItem(List=pshift_2, Index=0, Wrap=True)

path_mapper_8 = PathMapper(geo_12, source="{A;B}", target="{A;B+1}")
path_mapper_9 = PathMapper(item_29, source="{A;B}", target="{A;B+1}")

end_12 = EndPoints(Curve=path_mapper_9)  # -> Start, End
geo_13 = Geometry([path_mapper_2, path_mapper_3, path_mapper_8])
# smoothing ends
end_13 = EndPoints(Curve=geo_13)  # -> Start, End
geo_14 = Geometry([end_12.Start, end_12.End])
geo_15 = Geometry([end_13.Start, end_13.End])
path_mapper_10 = PathMapper(geo_15, source="{A;B}", target="{A}")
item_30 = ListItem(List=path_mapper_10, Index=0, Wrap=True)
geo_16 = Geometry(path_mapper_10)
# Deviation foundation here!
ptsortitems = PointSortItems(Start=item_30, Points=geo_16)  # -> SortedItems, SortedIndices, simplify(SortedPoints)
intcrv = Interpolate(Vertices=ptsortitems.SortedPoints, Degree=3, Periodic=False, KnotStyle=1)  # -> Curve, Length, Domain
lng_9 = ListLength(List=ptsortitems.SortedPoints)
crest_plane_elevation_2 = RemoteReceiver(crest_plane_elevation)
plane_elevations_5 = RemoteReceiver(plane_elevations)
number_slider_11 = Slider(50, range=0..100)
smocrv = SmoothCurve(Curve=intcrv.Curve, Steps=lng_9, StartType=0, EndType=0, DeviationTolerance=Slider(6, range=0..50), AngleTolerance=0.05)
merge_13 = Merge(Data1=flatten(crest_plane_elevation_2), Data2=flatten(plane_elevations_5))
ext_4 = ExtendCurve(Curve=geo_13, Type=1, Start=number_slider_11, End=number_slider_11)
cull_i_9 = CullIndex(List=merge_13, Indices=-1, Wrap=True)
pcx_9 = CurvePlane(Curve=smocrv, Plane=cull_i_9)  # -> simplify(Points), ParamsC, ParamsP
crv_cp_3 = CurveClosestPoint(Point=pcx_9.Points, Curve=ext_4)  # -> Point, Parameter, Distance
dispatch_10 = Dispatch(List=crv_cp_3.Point, DispatchPattern=[True, False])  # -> ListA, ListB
item_31 = ListItem(List=dispatch_10.ListA, Index=0, Wrap=True)
item_32 = ListItem(List=dispatch_10.ListB, Index=0, Wrap=True)
geo_17 = Geometry(geo_14)
geo_18 = Geometry([item_31, item_32, geo_17])

pshift_3 = ShiftPaths(Data=geo_18, Offset=-1)
item_33 = ListItem(List=pshift_3, Index=0, Wrap=True)
ptsortitems_2 = PointSortItems(Start=item_33, Points=pshift_3)  # -> SortedItems, SortedIndices, SortedPoints
path_mapper_11 = PathMapper(ext_4, source="{A;B}", target="{A}")
intcrv_2 = Interpolate(Vertices=ptsortitems_2.SortedPoints, Degree=Slider(3, range=0..10), Periodic=False, KnotStyle=1)  # -> simplify(Curve), Length, Domain
ccx_6 = CurveCurve(CurveA=path_mapper_11, CurveB=intcrv_2.Curve)  # -> Points, ParamsA, ParamsB
shatter_9 = Shatter(Curve=ext_4, Parameters=ccx_6.ParamsA)  # -> simplify(Segments)
dispatch_11 = Dispatch(List=shatter_9, DispatchPattern=[True, False])  # -> ListA, ListB
geo_19 = Geometry(dispatch_11.ListB)

geo_20 = Geometry(geo_19)
tstat_3 = TreeStatistics(Tree=geo_20)  # -> Paths, Length, Count
division_4 = Division(A=tstat_3.Count, B="2")
split_7 = SplitList(List=tstat_3.Paths, Index=division_4)  # -> ListA, ListB
item_34 = ListItem(List=split_7.ListA, Index=-1, Wrap=True)
item_35 = ListItem(List=split_7.ListB, Index=-1, Wrap=True)
cull_i_10 = CullIndex(List=split_7.ListA, Indices=-1, Wrap=True)  # -> flatten(List)
cull_i_11 = CullIndex(List=split_7.ListB, Indices=-1, Wrap=True)  # -> flatten(List)
path_3 = DataPath(flatten([cull_i_10, cull_i_11]))
split_8 = SplitTree(Data=geo_20, Masks=flatten(path_3))  # -> Positive, Negative
split_9 = SplitTree(Data=geo_20, Masks=flatten("{?;0}"))  # -> Positive, Negative
unflatten_2 = UnflattenTree(Tree=intcrv_2.Curve, Guide=split_8.Negative)
unflatten_3 = UnflattenTree(Tree=split_9.Negative, Guide=split_8.Positive)
geo_21 = Geometry([split_8.Positive, unflatten_3])
path_mapper_12 = PathMapper(unflatten_3, source="{A;B}", target="{A}")
lng_10 = ListLength(List=path_mapper_12)
repeat = RepeatData(Data=intcrv_2.Curve, Length=lng_10)
unflatten_4 = UnflattenTree(Tree=repeat, Guide=unflatten_3)
ccx_7 = CurveCurve(CurveA=unflatten_4, CurveB=geo_21)  # -> Points, simplify(ParamsA), ParamsB
pshift_4 = ShiftPaths(Data=ccx_7.ParamsA, Offset=-1)
shatter_10 = Shatter(Curve=unflatten_4, Parameters=pshift_4)  # -> simplify(Segments)
lng_11 = ListLength(List=shatter_10)
python = GhPythonScript(x=lng_11, y=shatter_10)  # -> out, a, b
# ---------- python: Python ----------
__author__ = "Admin"
__version__ = "2023.08.14"

import rhinoscriptsyntax as rs

if x == 3:
    a = y
elif x == 5:
    b = y
# ---------- end python ----------
clean_7 = CleanTree(RemoveNulls=True, RemoveInvalid=True, RemoveEmpty=False, Tree=python.b)
clean_8 = CleanTree(RemoveNulls=True, RemoveInvalid=True, RemoveEmpty=False, Tree=python.a)
geo_22 = Geometry(split_8.Negative)
geo_23 = Geometry(unflatten_2)

equals_6 = Equality(FirstNumber=lng_11, SecondNumber="3")  # -> Equality, Inequality
dispatch_12 = Dispatch(List=shatter_10, DispatchPattern=equals_6.Equality)  # -> ListA, ListB
clean_9 = CleanTree(RemoveNulls=True, RemoveInvalid=True, RemoveEmpty=False, Tree=dispatch_12.ListA)
clean_10 = CleanTree(RemoveNulls=True, RemoveInvalid=True, RemoveEmpty=False, Tree=dispatch_12.ListB)

dispatch_13 = Dispatch(List=clean_10, DispatchPattern=[True, False])  # -> ListA, ListB
geo_24 = Geometry(clean_9)
geo_25 = Geometry(dispatch_13.ListB)
cull_i_12 = CullIndex(List=geo_24, Indices="1", Wrap=True)  # -> simplify(List)
geo_26 = Geometry([geo_21, geo_25, cull_i_12])
item_36 = ListItem(List=geo_26, Index=0, Wrap=True)  # -> Item, Item1, Item2, Item3
netsurf = NetworkSurface(CurvesU=[item_36.Item, item_36.Item1], CurvesV=[item_36.Item2, item_36.Item3], Continuity=3)

dispatch_14 = Dispatch(List=clean_7, DispatchPattern=[True, False])  # -> ListA, ListB
geo_27 = Geometry(clean_8)
cull_i_13 = CullIndex(List=geo_27, Indices="1", Wrap=True)  # -> simplify(List)
geo_28 = Geometry(dispatch_14.ListB)
geo_29 = Geometry([geo_21, geo_28, cull_i_13])
item_37 = ListItem(List=geo_29, Index=0, Wrap=True)  # -> Item, Item1, Item2, Item3
netsurf_2 = NetworkSurface(CurvesU=[item_37.Item, item_37.Item1], CurvesV=[item_37.Item2, item_37.Item3], Continuity=3)

# ----
# Creating surfaces
ccx_8 = CurveCurve(CurveA=geo_23, CurveB=geo_22)  # -> Points, ParamsA, ParamsB
shatter_11 = Shatter(Curve=geo_23, Parameters=ccx_8.ParamsA)
pshift_5 = ShiftPaths(Data=shatter_11, Offset=-1)
item_38 = ListItem(List=pshift_5, Index="1", Wrap=True)
loft_3 = Loft(
    Curves=[item_38, geo_22],
    Options={Adjust=True, Closed=False, LoftEnds=0, LoftSimp=0, LoftType=5, Rebuild=10, Refit=0.01})

tbi = TreeBranchIndex(DataTree=netsurf, BranchIndex=Slider(10, range=0..100))
tbi_2 = TreeBranchIndex(DataTree=netsurf_2, BranchIndex=Slider(10, range=0..100))
x_tremez_4 = Extremes(Curve=flatten(item_38), Plane=PlaneXY(0, 0, 0))  # -> Highest, Lowest
panel_80 = Panel(netsurf_2)
dam_9 = DataDam(DataA=loft_3, DataB=netsurf_2, BufferDelay=10000000, BufferMode=1)  # -> DataA, DataB
pt_8 = Point(x_tremez_4.Lowest)
foundation_point_arch_dam = RemoteSender(pt_8)
path_mapper_13 = PathMapper([dam_9.DataA, dam_9.DataB], source="{A;B}", target="{A}")
join_9 = BrepJoin(Breps=flatten(path_mapper_13))  # -> Breps, Closed
item_39 = ListItem(List=join_9.Breps, Index=Slider(2, range=0..10), Wrap=True)
item_40 = ListItem(List=join_9.Breps, Index=1, Wrap=True)  # -> Item, Item1
item_41 = ListItem(List=join_9.Breps, Index=0, Wrap=True)  # -> Item, Item1
arch_us_face = RemoteSender(item_40.Item1)
arch_ds_face = RemoteSender(item_40.Item)
arch_ds_face_2 = RemoteReceiver(arch_ds_face)
mesh_12 = Mesh(arch_ds_face_2)
filter_4 = StreamFilter(Gate=dam_type_8, Stream0=null, Stream1=mesh_12, Stream2=null)
loft_4 = Loft(
    Curves=flatten([item_41.Item, item_41.Item1]),
    Options={Adjust=True, Closed=False, LoftEnds=0, LoftSimp=0, LoftType=5, Rebuild=10, Refit=0.01})
join_10 = BrepJoin(Breps=flatten([join_9.Breps, loft_4]))  # -> Breps, Closed
mesh_13 = MeshBrep(Brep=join_10.Breps, Settings=jagged_2)
volume_4 = MeshVolume(Mesh=mesh_13)  # -> Volume, Centroid
geo_archdam = RemoteSender(mesh_13)
geo_archdam_2 = RemoteReceiver(geo_archdam)
mshclsd = IsMeshClosed(Mesh=geo_archdam_2)
panel_81 = Panel(mshclsd)
geo_archdam_3 = RemoteReceiver(geo_archdam)
filter_5 = StreamFilter(Gate=dam_type_9, Stream0=geo_concretedam_2, Stream1=geo_archdam_3, Stream2=geo_embankmentdam_2)

dam_10 = DataDam(DataWaterSectionMeshes=merge_9, DataDamGeometry=filter_5, DataDamCollision=filter_4, BufferDelay=10000000, BufferMode=1)  # -> DataWaterSectionMeshes, DataDamGeometry, DataDamCollision

gate = StreamGate(Stream=dam_10.DataWaterSectionMeshes, Gate=dam_type_10)  # -> Target0, Target1, Target2
gate_2 = StreamGate(Stream=dam_10.DataDamGeometry, Gate=dam_type_11)  # -> Target0, Target1, Target2
cullvertices = MeshCullUnusedVertices(Mesh=gate_2.Target1)
filter_6 = StreamFilter(Gate=dam_type_12, Stream1=gate.Target1, Stream2=gate.Target2)
filter_7 = StreamFilter(Gate=dam_type_12, Stream0=gate_2.Target0, Stream1=cullvertices, Stream2=gate_2.Target2)
mdif = MeshDifference(MeshesA=filter_6, MeshesB=filter_7)
disjoint_2 = DisjointMesh(Mesh=mdif)
volume_5 = Volume(Geometry=disjoint_2)  # -> Volume, Centroid; disabled
tbi_3 = TreeBranchIndex(DataTree=mdif, BranchIndex=number_slider_2)  # disabled
ma_2 = MassAddition(Input=flatten(volume_5.Volume))  # -> Result, PartialResults; disabled
path_mapper_14 = PathMapper(disjoint_2, source="{A;B}", target="{A}")
rebmsh = RebuildMesh(
    Mesh=mdif,
    RebuildNormals=toggle,
    CullUnused=toggle,
    UnifyNormals=toggle,
    FlipNormals=toggle,
    IdenticalCombine=toggle,
    WeldVertices=number_slider_3)  # disabled
subtraction_4 = Subtraction(A=ma.Result, B=ma_2.Result)  # disabled
disjoint_3 = DisjointMesh(Mesh=rebmsh)  # disabled
colom_5 = CollisionOneMany(Collider=path_mapper_14, Obstacles=dam_10.DataDamCollision)  # -> Collision, Index
dispatch_15 = Dispatch(List=path_mapper_14, DispatchPattern=colom_5.Index)  # -> ListA, ListB
geo_30 = Geometry(simplify(gate.Target0))
geo_31 = Geometry(dispatch_15.ListA)
gate_3 = StreamGate(Stream=geo_31, Gate=dam_type_13)  # -> Target0, Target1, Target2
filter_8 = StreamFilter(Gate=dam_type_14, Stream0=geo_30, Stream1=gate_3.Target1, Stream2=gate_3.Target2)
flatten_3 = FlattenTree(Tree=filter_8, Path="{0}")
archdam_volume = RemoteSender(volume_4.Volume)
foundation_point_arch_dam_2 = RemoteReceiver(foundation_point_arch_dam)
arch_us_face_2 = RemoteReceiver(arch_us_face)
archdam_volume_2 = RemoteReceiver(archdam_volume)
m3_to_hm3 = Expression(x=archdam_volume_2, Expression="x/1000000")
area = Area(Geometry=arch_us_face_2)  # -> Area, Centroid
sort_11 = SortList(Keys=foundation_point_arch_dam_2, ValuesA=foundation_point_arch_dam_2)  # -> Keys, ValuesA
expression_18 = Expression(S=area.Area, H=arch_dam_height_5, V=archdam_volume_2, Expression="(s²)/(H*V)")
item_42 = ListItem(List=sort_11.ValuesA, Index=0, Wrap=True)
pdecon_8 = Deconstruct(Point=item_42)  # -> XComponent, YComponent, ZComponent

# ----
# Line of centers
reference_centers_outline_2 = RemoteReceiver(reference_centers_outline)  # disabled
reference_centers_plane_4 = RemoteReceiver(reference_centers_plane)  # disabled
refecenre_centers_vector_4 = RemoteReceiver(refecenre_centers_vector)  # disabled
line_of_centers_intrados_3 = RemoteReceiver(line_of_centers_intrados)  # disabled
line_of_centers_extrados_3 = RemoteReceiver(line_of_centers_extrados)  # disabled
abiscissa_dam_axis_3 = RemoteReceiver(abiscissa_dam_axis)  # disabled
number_slider_12 = Slider(5, range=0..50)  # disabled
ds_arc_6 = RemoteReceiver(ds_arc)  # disabled
us_arc_5 = RemoteReceiver(us_arc)  # disabled
us_ds_slices_intersections_2 = RemoteReceiver(us_ds_slices_intersections)  # disabled
points_lineofcenters_2 = RemoteReceiver(points_lineofcenters)  # disabled
swatch_4 = ColourSwatch(SwatchColor=RGB(164, 24, 219))  # disabled
number_slider_13 = Slider(50, range=0..100)  # disabled
swatch_5 = ColourSwatch(SwatchColor=RGB(69, 69, 69))  # disabled
objfromgroup_7 = GetObjectsInGroup()
symadv = SymbolAdvanced(Style=5, SizePrimary=number_slider_12, SizeSecondary=10, Rotation=0, Fill=swatch_4, Edge=swatch_4, Width=2, Adjust=True)  # disabled
amp_7 = Amplitude(Vector=refecenre_centers_vector_4, Amplitude=number_slider_13)  # disabled
vdisex_2 = VectorDisplayEx(Point=reference_centers_plane_4, Vector=amp_7, Colour=RGB(0, 0, 0), Width=2)  # disabled
curve_preview = CustomCurvePreview(Curve=reference_centers_outline_2, Linetype="Continuous", Colour=swatch_5)  # disabled
symbol = SymbolDisplay(Location=[points_lineofcenters_2, us_ds_slices_intersections_2], Display=symadv)  # disabled
curve_preview_2 = CustomCurvePreview(Curve=[ds_arc_6, us_arc_5], Linetype=<geometry referenced from the Rhino model>, Colour=swatch_5)  # disabled
curve_preview_3 = CustomCurvePreview(
    Curve=[line_of_centers_intrados_3, line_of_centers_extrados_3],
    Linetype=<geometry referenced from the Rhino model>,
    Colour=swatch_5)  # disabled
flip_2 = FlipMatrix(Data=points_lineofcenters_2)  # disabled
panel_82 = Panel("{0}")  # disabled
reference_centers_plane_5 = RemoteReceiver(reference_centers_plane)  # disabled
center_crest_3 = RemoteReceiver(center_crest)  # disabled
split_10 = SplitTree(Data=flip_2, Masks=flatten(panel_82))  # -> Positive, Negative; disabled
pt_9 = Point([split_10.Positive, center_crest_3])  # disabled
number_slider_14 = Slider(86, range=0..100)  # disabled
deplane = DeconstructPlane(Plane=reference_centers_plane_5)  # -> Origin, XAxis, YAxis, ZAxis; disabled
amp_8 = Amplitude(Vector=deplane.XAxis, Amplitude=number_slider_14)  # disabled
pdecon_9 = Deconstruct(Point=pt_9)  # -> XComponent, YComponent, ZComponent; disabled
roundf = RoundToFactor(NumberX=pdecon_9.ZComponent, Factor=0.1, RoundType=0)  # -> Rounded, Difference, MultiplierR, MultiplierX; disabled
move_10 = Move(Geometry=pt_9, Motion=amp_8)  # -> Geometry, Transform; disabled
pln_5 = Plane(reference_centers_plane_5)  # disabled
ln_11 = Line(StartPoint=pt_9, EndPoint=move_10.Geometry)  # disabled
leader_text_settings_2 = RemoteReceiver(leader_text_settings)  # disabled
leader = Leader(Curve=ln_11, Text=roundf.Rounded, Plane=pln_5, TextSettings=leader_text_settings_2)  # -> Leader, Curve, Text, Plane, TextSettings, ArrowSettings, LeaderSettings; disabled

roundd_9 = RoundToDecimalPlace(NumberX=m3_to_hm3, DecimalPlace=Slider(2, range=0..10), RoundType=0)  # -> flatten(Rounded), Difference
roundd_10 = RoundToDecimalPlace(NumberX=expression_18, DecimalPlace=number_slider_4, RoundType=0)  # -> flatten(Rounded), Difference
roundd_11 = RoundToDecimalPlace(NumberX=pdecon_8.ZComponent, DecimalPlace=number_slider_4, RoundType=0)  # -> flatten(Rounded), Difference
roundd_12 = RoundToDecimalPlace(NumberX=area.Area, DecimalPlace=number_slider_4, RoundType=0)  # -> flatten(Rounded), Difference
panel_83 = Panel(roundd_10.Rounded)
panel_84 = Panel(roundd_9.Rounded)
lng_12 = ListLength(List=objfromgroup_7)
dup_7 = DuplicateData(Data=show_line_of_centers, Number=lng_12, Order=True)
merge_14 = Merge(
    Data1=dam_axis_name_5,
    Data2=dam_name_translation_5,
    Data3=roundd_8.Rounded,
    Data4=roundd_11.Rounded,
    Data5=normal_water_level_7,
    Data6=dam_level_4,
    Data7=roundd_3.Rounded,
    Data8=width_base_2,
    Data9=width_crest_3,
    Data10=width_0_45_2,
    Data11=roundd.Rounded,
    Data12=roundd_2.Rounded,
    Data13=roundd_4.Rounded,
    Data14=roundd_12.Rounded,
    Data15=roundd_9.Rounded,
    Data16=roundd_10.Rounded)
not = GateNot(A=dup_7)
panel_85 = Panel(merge_14)
geo_archdam_4 = RemoteReceiver(geo_archdam)
onoff_4 = EnableDisableObject(
    Objects=objfromgroup_7,
    Enabled=dup_7,
    AllObjects_Object=[vdisex_2, amp_7, number_slider_13, line_of_centers_intrados_3, line_of_centers_extrados_3, curve_preview_3, us_arc_5, ds_arc_6, curve_preview_2, swatch_5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])
transform_3 = Transform(Geometry=geo_archdam_4, Transform=transform_origin_4)

# ----
# Dam
dam_type_15 = RemoteReceiver(dam_type_2)
geo_concretedam_3 = RemoteReceiver(geo_concretedam)
geo_archdam_5 = RemoteReceiver(geo_archdam)
geo_embankmentdam_3 = RemoteReceiver(geo_embankmentdam)
filter_9 = StreamFilter(Gate=dam_type_15, Stream0=geo_concretedam_3, Stream1=geo_archdam_5, Stream2=geo_embankmentdam_3)
chord_dam_8 = RemoteReceiver(chord_dam)
swatch_6 = ColourSwatch(SwatchColor=RGB(207, 151, 68))
preview_2 = CustomPreview(Geometry=filter_9, Material=swatch_6)
curve_preview_4 = CustomCurvePreview(Curve=chord_dam_8, Linetype=<geometry referenced from the Rhino model>, Colour=swatch_6)

# ----
# Levels
levels_at_water_height_2 = RemoteReceiver(levels_at_water_height)
levels_dam_height_2 = RemoteReceiver(levels_dam_height)
curve_preview_5 = CustomCurvePreview(Curve=levels_dam_height_2, Linetype=<geometry referenced from the Rhino model>, Colour=swatch_6)
curve_preview_6 = CustomCurvePreview(
    Curve=levels_at_water_height_2,
    Linetype=<geometry referenced from the Rhino model>,
    Colour=ColourSwatch(SwatchColor=RGB(2, 102, 189)))

geo_archdam_6 = RemoteReceiver(geo_archdam)  # disabled
archdam_volume_3 = RemoteReceiver(archdam_volume)  # disabled
format_5 = Format(
    Format=panel_43,
    Culture=127,
    Data0=normal_water_level_9,
    Data1=dam_level_5,
    Data2=pdecon.ZComponent,
    Data3=arch_dam_height_6,
    Data4=axis_straight_terrain_2,
    Data5=len_4,
    Data6=len_6,
    Data7=archdam_volume_3)  # disabled
archdam_volume_4 = RemoteReceiver(archdam_volume)  # disabled
archdam_volume_5 = RemoteReceiver(archdam_volume)  # disabled
entwine_3 = Entwine(
    Branch00=normal_water_level_10,
    Branch01=dam_level_6,
    Branch02=pdecon.ZComponent,
    Branch03=arch_dam_height_7,
    Branch04=archdam_volume_4,
    Branch05=len_4,
    Branch06=len_6,
    Branch07=archdam_volume_5,
    FlattenInputs=True)  # -> flatten(Result); disabled
panel_86 = Panel(entwine_3)  # disabled
transform_4 = Transform(Geometry=geo_archdam_6, Transform=transform_origin_5)  # disabled
geo_32 = Geometry(flatten(transform_4))  # disabled
merge_15 = Merge(Data1=panel_86, Data2=trim)  # disabled
join_11 = TextJoin(Text=merge_15, Join=panel_51)  # disabled
panel_87 = Panel([join_8, join_11])  # disabled
panel_88 = Panel(merge_15)  # disabled
num_5 = Number(panel_88)  # disabled
move_11 = Move(Geometry=geo_archdam_6, Motion=transform_origin_6)  # -> Geometry, Transform; disabled
exportvector = ExportVector(
    VectorDataFilename=concat_7,
    VectorDataFolder=concat_8,
    Fields=panel_55,
    Values=num_3,
    FeatureGeometry=move_11.Geometry,
    Export=button_4,
    DriverExtension=".shp",
    DriverType="ESRI Shapefile")  # disabled
exportvector_2 = ExportVector(
    VectorDataFilename=concat_6,
    VectorDataFolder=concat_8,
    Fields=panel_59,
    Values=panel_58,
    FeatureGeometry=geo_32,
    Export=button_5,
    DriverExtension=".shp",
    DriverType="ESRI Shapefile")  # disabled
exportvector_3 = ExportVector(
    VectorDataFilename=concat_6,
    VectorDataFolder=concat_8,
    Fields=panel_79,
    Values=num_5,
    FeatureGeometry=geo_32,
    Export=button_6,
    DriverExtension=".shp",
    DriverType="ESRI Shapefile")  # disabled
panel_89 = Panel(exportvector)  # disabled

# ----
# Values
# Fields
# Fields
geo_33 = Geometry(simplify(graft(flatten_3)))
dup_8 = DuplicateDataMatch(SourceDataTree=filter_8, SecondaryData1=dam_8)  # -> SourceData, SecondaryData1
volume_6 = Volume(Geometry=geo_33)  # -> Volume, Centroid
debox = DeconstructBox(Box=geo_33)  # -> Plane, X, Y, Z
dedomain = DeconstructDomain(Domain=debox.Z)  # -> Start, End
m3_to_hm3_2 = Expression(x=volume_6.Volume, Expression="x/1000000")
roundd_13 = RoundToDecimalPlace(NumberX=m3_to_hm3_2, DecimalPlace=Slider(2, range=0..10), RoundType=0)  # -> Rounded, Difference
dam_name_translation_6 = RemoteReceiver(dam_name_translation)
normal_water_level_11 = RemoteReceiver(normal_water_level)
dam_axis_name_7 = RemoteReceiver(dam_axis_name)
dup_9 = DuplicateDataMatch(SourceDataTree=roundd_13.Rounded, SecondaryData1=dam_axis_name_7)  # -> SourceData, SecondaryData1
dup_10 = DuplicateDataMatch(SourceDataTree=roundd_13.Rounded, SecondaryData1=dam_name_translation_6)  # -> SourceData, SecondaryData1
dup_11 = DuplicateDataMatch(SourceDataTree=roundd_13.Rounded, SecondaryData1=normal_water_level_11)  # -> SourceData, SecondaryData1
fields_water_3 = RemoteReceiver(fields_water)
panel_90 = Panel(fields_water_3)

water_total_geo = RemoteSender(geo_33)

# ---- group: Check - Volume final
volume_7 = Volume(Geometry=dispatch_15.ListB)  # -> Volume, Centroid; disabled
ma_3 = MassAddition(Input=flatten(volume_7.Volume))  # -> Result, PartialResults; disabled
ma_4 = MassAddition(Input=flatten(volume_6.Volume))  # -> Result, PartialResults; disabled
subtraction_5 = Subtraction(A=ma.Result, B=ma_3.Result, C=subtraction_4)  # disabled
volume_final = Panel(ma_4.Result)  # disabled
volume_test = Panel(subtraction_5)  # disabled

# ----
unflatten_5 = UnflattenTree(Tree=dup_8.SecondaryData1, Guide=geo_33)
is_dead = RemoteSender(unflatten_5)

# ---- group: Rounding to 0.1
number_slider_15 = Slider(1, range=0..10)
roundd_14 = RoundToDecimalPlace(NumberX=dedomain.Start, DecimalPlace=number_slider_15, RoundType=0)  # -> Rounded, Difference
roundd_15 = RoundToDecimalPlace(NumberX=dedomain.End, DecimalPlace=number_slider_15, RoundType=0)  # -> Rounded, Difference

# ----
water_total_volume = RemoteSender(roundd_13.Rounded)

num_6 = Number(roundd_14.Rounded)
num_7 = Number(roundd_15.Rounded)
merge_16 = Merge(
    Data1=dup_9.SecondaryData1,
    Data2=dup_10.SecondaryData1,
    Data3=dup_11.SecondaryData1,
    Data4=num_6,
    Data5=num_7,
    Data6=roundd_13.Rounded,
    Data7=unflatten_5)
panel_91 = Panel(merge_16)

values_water = RemoteSender(merge_16)
values_water_2 = RemoteReceiver(values_water)
water_total_geo_2 = RemoteReceiver(water_total_geo)
transform_5 = Transform(Geometry=water_total_geo_2, Transform=transform_origin_2)

dam_11 = DataDam(
    DataA=panel_34,
    DataB=panel_39,
    DataC=panel_33,
    DataD=values_water_2,
    DataE=transform_5,
    BufferDelay=10000000,
    BufferMode=0)  # -> DataA, DataB, DataC, DataD, DataE
dam_12 = DataDam(DataA=panel_35, DataE=panel_40, DataB=crv, DataC=item_13, DataD=dam_axis_name_6, BufferDelay=10000000, BufferMode=0)  # -> DataA, DataE, DataB, DataC, DataD
dam_13 = DataDam(DataA=panel_36, DataB=panel_41, DataC=panel_37, DataD=merge_14, DataE=transform_3, BufferDelay=10000000, BufferMode=0)  # -> DataA, DataB, DataC, DataD, DataE
objfromgroup_8 = GetObjectsInGroup()

output = DataOutput(
    A=dam_11.DataA,
    B=dam_11.DataB,
    C=dam_11.DataC,
    D=dam_11.DataD,
    E=dam_11.DataE,
    Destination="C:\Users\Admin\Documents\Github\EarlyStageDesign\JD\Skripts\ghData\Water_test_to_export.ghdata",
    RelativePath="C:\Users\Admin\Documents\Github\EarlyStageDesign\JD\Skripts\ghData\Water_test_to_export.ghdata|ghData\Water_test_to_export.ghdata")
output_2 = DataOutput(
    D=dam_12.DataA,
    E=dam_12.DataE,
    A=dam_12.DataB,
    C=dam_12.DataC,
    B=dam_12.DataD,
    Destination="C:\Users\Admin\Documents\Github\EarlyStageDesign\JD\Skripts\ghData\DamAxis.ghdata",
    RelativePath="C:\Users\Admin\Documents\Github\EarlyStageDesign\JD\Skripts\ghData\DamAxis.ghdata|ghData\DamAxis.ghdata")
output_3 = DataOutput(
    A=dam_13.DataA,
    B=dam_13.DataB,
    C=dam_13.DataC,
    D=dam_13.DataD,
    E=dam_13.DataE,
    Destination="C:\Users\Admin\Documents\Github\EarlyStageDesign\JD\Skripts\ghData\ArchDam_test_to_export.ghdata",
    RelativePath="C:\Users\Admin\Documents\Github\EarlyStageDesign\JD\Skripts\ghData\ArchDam_test_to_export.ghdata|ghData\ArchDam_test_to_export.ghdata")
lng_13 = ListLength(List=objfromgroup_8)
panel_92 = Panel(dam_12.DataD)
dup_12 = DuplicateData(Data=send_to_export, Number=lng_13, Order=True)
panel_93 = Panel(dam_12.DataC)
# Arch dam
# Water
water_total_geo_3 = RemoteReceiver(water_total_geo)
is_dead_2 = RemoteReceiver(is_dead)
setobj_4 = SetObjectValue(ObjectToSet=objfromgroup_8, ValueToSet=dup_12)
not_2 = GateNot(A=is_dead_2)
dispatch_16 = Dispatch(List=water_total_geo_3, DispatchPattern=not_2)  # -> ListA, ListB

# ----
# Text  Arch Dam
# Text water volume
# Text axis
# Text water level
# Text dam level
levels_at_water_height_3 = RemoteReceiver(levels_at_water_height)
levels_dam_height_3 = RemoteReceiver(levels_dam_height)
water_total_geo_4 = RemoteReceiver(water_total_geo)
is_dead_3 = RemoteReceiver(is_dead)
water_total_volume_2 = RemoteReceiver(water_total_volume)
is_dead_4 = RemoteReceiver(is_dead)
dam_type_16 = RemoteReceiver(dam_type_2)
gravity_volume_2 = RemoteReceiver(gravity_volume)
archdam_volume_6 = RemoteReceiver(archdam_volume)
embankment_volume_2 = RemoteReceiver(embankment_volume)
dam_type_17 = RemoteReceiver(dam_type_2)
chord_dam_9 = RemoteReceiver(chord_dam)
point_crest_3 = RemoteReceiver(point_crest)
not_3 = GateNot(A=is_dead_4)
dam_axis_name_8 = RemoteReceiver(dam_axis_name)
chord_dam_10 = RemoteReceiver(chord_dam)
midpt_3 = CurveMiddle(Curve=chord_dam_9)
font_size_2 = RemoteReceiver(font_size)
not_4 = GateNot(A=is_dead_3)
dispatch_17 = Dispatch(List=water_total_volume_2, DispatchPattern=not_3)  # -> ListA, ListB
number_slider_16 = Slider(0.9, range=0..1)
number_slider_17 = Slider(100, range=0..100)
number_slider_18 = Slider(0.99, range=0..1)
filter_10 = StreamFilter(Gate=dam_type_16, Stream0=gravity_volume_2, Stream1=archdam_volume_6, Stream2=embankment_volume_2)
filter_11 = StreamFilter(Gate=dam_type_17, Stream0=midpt_3, Stream1=point_crest_3, Stream2=midpt_3)
number_slider_19 = Slider(0.2, range=0..1)
number_slider_20 = Slider(100, range=0..100)
dispatch_18 = Dispatch(List=water_total_geo_4, DispatchPattern=not_4)  # -> ListA, ListB
number_slider_21 = Slider(100, range=0..100)
ma_5 = MassAddition(Input=flatten(dispatch_17.ListA))  # -> Result, PartialResults
ma_6 = MassAddition(Input=flatten(dispatch_17.ListB))  # -> Result, PartialResults
panel_94 = Panel("Volume: {0:0,0} m3")
mesh_14 = Mesh(flatten(dispatch_18.ListA))
panel_95 = Panel("""Total capacity: {0:0,0.0} hm3
Useful capacity: {1:0,0.0} hm3
Dead capacity: {2:,0.00} hm3""")
number_slider_22 = Slider(100, range=0..100)
mesh_15 = Mesh(flatten(dispatch_18.ListB))
ma_7 = MassAddition(Input=flatten([ma_5.Result, ma_6.Result]))  # -> Result, PartialResults
Z_9 = UnitZ(Factor=number_slider_17)
item_43 = ListItem(List=flatten(mesh_14), Index=0, Wrap=True)
Z_10 = UnitZ(Factor=number_slider_20)
eval_6 = EvaluateCurve(Curve=reparameterize(chord_dam_10), Parameter=number_slider_19)  # -> Point, Tangent, Angle
Z_11 = UnitZ(Factor=number_slider_21)
format_6 = Format(Format=panel_94, Culture=2055, Data0=filter_10)
center_7 = Center(Geometry=flatten(dispatch_18.ListA), forall=True)  # -> Center, Dimension
center_8 = Center(Geometry=mesh_15, forall=True)  # -> Center, Dimension
center_9 = Center(Geometry=item_43, forall=True)  # -> Center, Dimension
move_12 = Move(Geometry=eval_6.Point, Motion=Z_11)  # -> Geometry, Transform
Z_12 = UnitZ(Factor=number_slider_22)
panel_96 = Panel(format_6)
format_7 = Format(Format=panel_95, Culture=2055, Data0=ma_7.Result, Data1=ma_5.Result, Data2=ma_6.Result)
move_13 = Move(Geometry=filter_11, Motion=Z_12)  # -> Geometry, Transform
ln_12 = Line(StartPoint=eval_6.Point, EndPoint=move_12.Geometry)
item_44 = ListItem(List=format_7, Index=0, Wrap=True)  # -> Item, Item1, Item2
ln_13 = Line(StartPoint=filter_11, EndPoint=move_13.Geometry)
number_slider_23 = Slider(324, range=0..500)
number_slider_24 = Slider(336, range=0..500)
number_slider_25 = Slider(293, range=0..500)
font_size_3 = RemoteReceiver(font_size)
font_size_4 = RemoteReceiver(font_size)
panel_97 = Panel("Crest level: {0:0,0} m")
leader_2 = RemoteSender(ln_12)
leader_3 = RemoteSender(ln_13)
panel_98 = Panel("Water level: {0:0,0} m")
font_size_5 = RemoteReceiver(font_size)
objfromgroup_9 = GetObjectsInGroup()
Z_13 = UnitZ(Factor=number_slider_24)
Z_14 = UnitZ(Factor=number_slider_23)
Z_15 = UnitZ(Factor=number_slider_25)
move_14 = Move(Geometry=center_7.Center, Motion=Z_13)  # -> Geometry, Transform
move_15 = Move(Geometry=center_9.Center, Motion=Z_14)  # -> Geometry, Transform
move_16 = Move(Geometry=center_8.Center, Motion=Z_15)  # -> Geometry, Transform
entwine_4 = Entwine(Branch00=item_44.Item, Branch01=item_44.Item1, FlattenInputs=True)
entwine_5 = Entwine(Branch00=move_14.Geometry, Branch01=move_15.Geometry, FlattenInputs=True)
ln_14 = Line(StartPoint=center_7.Center, EndPoint=move_14.Geometry)
ln_15 = Line(StartPoint=center_9.Center, EndPoint=move_15.Geometry)
ln_16 = Line(StartPoint=center_8.Center, EndPoint=move_16.Geometry)

item_45 = ListItem(List=levels_dam_height_3, Index=0, Wrap=True)
item_46 = ListItem(List=levels_at_water_height_3, Index=0, Wrap=True)

eval_7 = EvaluateCurve(Curve=reparameterize(item_45), Parameter=number_slider_16)  # -> Point, Tangent, Angle
eval_8 = EvaluateCurve(Curve=reparameterize(item_46), Parameter=number_slider_18)  # -> Point, Tangent, Angle
move_17 = Move(Geometry=eval_7.Point, Motion=Z_9)  # -> Geometry, Transform
move_18 = Move(Geometry=eval_8.Point, Motion=Z_10)  # -> Geometry, Transform
ln_17 = Line(StartPoint=eval_7.Point, EndPoint=move_17.Geometry)
ln_18 = Line(StartPoint=eval_8.Point, EndPoint=move_18.Geometry)
pdecon_10 = Deconstruct(Point=eval_7.Point)  # -> XComponent, YComponent, ZComponent
pdecon_11 = Deconstruct(Point=eval_8.Point)  # -> XComponent, YComponent, ZComponent
leader_4 = RemoteSender(ln_17)
leader_5 = RemoteSender(ln_18)
format_8 = Format(Format=panel_97, Culture=2055, Data0=pdecon_10.ZComponent)
format_9 = Format(Format=panel_98, Culture=2055, Data0=pdecon_11.ZComponent)

text_dot = TextDot(Location=move_12.Geometry, PrimaryText=dam_axis_name_8, TextHeight=font_size_2)
text_dot_2 = TextDot(Location=move_13.Geometry, PrimaryText=panel_96, TextHeight=font_size_5)
text_dot_3 = TextDot(Location=move_17.Geometry, PrimaryText=format_8, TextHeight=font_size_3)
text_dot_4 = TextDot(Location=move_18.Geometry, PrimaryText=format_9, TextHeight=font_size_4)
lng_14 = ListLength(List=objfromgroup_9)

font_size_6 = RemoteReceiver(font_size)
text_dot_5 = TextDot(Location=move_16.Geometry, PrimaryText=item_44.Item2, TextHeight=font_size_6)
leader_6 = RemoteSender(ln_16)
preview_3 = CustomPreview(Geometry=dispatch_16.ListB, Material=material_2)
objfromgroup_10 = GetObjectsInGroup()

dup_13 = DuplicateData(Data=show_text, Number=lng_14, Order=True)

font_size_7 = RemoteReceiver(font_size)
text_dot_6 = TextDot(Location=entwine_5, PrimaryText=entwine_4, TextHeight=font_size_7)
leader_7 = RemoteSender(ln_14)
leader_8 = RemoteSender(ln_15)
preview_4 = CustomPreview(Geometry=dispatch_16.ListA, Material=material_2)
objfromgroup_11 = GetObjectsInGroup()

leader_9 = RemoteReceiver([leader_7, leader_8, leader_6, leader_3, leader_2, leader_5, leader_4])
curve_preview_7 = CustomCurvePreview(Curve=leader_9, Linetype=<geometry referenced from the Rhino model>, Colour=ColourSwatch(SwatchColor=RGB(69, 69, 69)))
onoff_5 = EnableDisableObject(
    Objects=objfromgroup_9,
    Enabled=dup_13,
    AllObjects_Object=[is_dead_3, water_total_volume_2, water_total_geo_4, dispatch_18, dispatch_17, not_4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])
lng_15 = ListLength(List=objfromgroup_10)
lng_16 = ListLength(List=objfromgroup_11)
dup_14 = DuplicateData(Data=show_dead_capacity, Number=lng_15, Order=True)
dup_15 = DuplicateData(Data=show_useful_capacity, Number=lng_16, Order=True)
onoff_6 = EnableDisableObject(Objects=objfromgroup_10, Enabled=dup_14, AllObjects_Object=[preview_3, leader_6, font_size_6, text_dot_5])
onoff_7 = EnableDisableObject(Objects=objfromgroup_11, Enabled=dup_15, AllObjects_Object=[preview_4, leader_7, leader_8, font_size_7, text_dot_6])

# ==== cluster GHPythonRemote: Connects the Grasshopper Python component to an external Python instance.
python = PythonScript()  # -> gh_parent_doc_dir
# ---------- python: Python ----------
from os import path

gh_parent_doc_dir = path.abspath(path.dirname(ghenv.Component.OnPingDocument().Owner.OnPingDocument().FilePath))
# ---------- end python ----------
# GH to python remote example.
# Pierre Cuvilliers, 2017-2018
# Released under the MIT license
# github.com/pilcru/ghpythonremote
# Runs and connects to an external python engine, and
# assigns imported modules to scriptcontext.sticky variables.
# 
# Arguments:
#       code (str): Path to the GH_to_python_sticky.py code file.
#       location (str): Path to a python executable, or to a folder
#             containing `python.exe`, or the name of a conda-created
#             virtual environment prefixed by `conda://` (`conda://env_name`).
#             If empty, finds python from your windows %PATH%.
#       run (boolean): Creates the connection, and imports new
#             modules, when turned to True. Kills the connection,
#             and deletes the references to the imports, when turned
#             to False.
#       modules (str list): List of module names to import in the
#             remote python. They will be added to the
#             scriptcontext.sticky dictionary, allowing them to be
#             reused from other python components in the same
#             Grasshopper document. Submodules (for example
#             `numpy.linalg` have to be added explicitly to this list
#             to be available later.
#       log_level (str from ['NOTSET', 'DEBUG', 'INFO', 'WARNING', 'ERROR', 'CRITICAL']):
#             Logging level to use for the local IronPython and the
#             remote python instance.
#       working_dir (str): Working directory for the remote python
#             instance.
# 
# Returns:
#       out (str): Console output with DEBUG information.
#       linked_modules (str list): list of imported module names.
#       rpy (rpyc connection object): The object representing the
#             remote Python interpreter.
location = ClusterInput()  # location (str): Path to a python executable, or to a folder containing `python.exe`, or the name of a conda-created virtual environment prefixed by `conda://` (`conda://env_name`). If empty, finds python from your windows %PATH%.
run = ClusterInput()  # run (boolean): Creates the connection, and imports new modules, when turned to True. Kills the connection,and deletes the references to the imports, when turned to False.
modules = ClusterInput()  # modules (str list): List of module names to import in the remote python. They will be added to the scriptcontext.sticky dictionary, allowing them to be reused from other python components in the same Grasshopper document. Submodules (for example `numpy.linalg` have to be added explicitly to this list to be available later.
list = ValueList({"CRITICAL", "ERROR", "WARNING", "INFO", "DEBUG", "NOTSET"}, selected="DEBUG")
panel = Panel(python)
ghpythonremote = GHPythonRemote(location=location, run=run, modules=modules, log_level=list, working_dir=panel)  # -> out, linked_modules, rpy; inputs run: Boolean, modules: list
# ---------- ghpythonremote: Python ----------
import inspect
import logging
from os import path
import sys
from time import sleep

import scriptcontext

import ghpythonremote
from ghpythonremote.connectors import GrasshopperToPythonRemote

local_log_level = getattr(logging, log_level, logging.WARNING)
logger = logging.getLogger("ghpythonremote")
logger.setLevel(local_log_level)
ch = logging.StreamHandler()
ch.setLevel(local_log_level)
formatter = logging.Formatter("%(levelname)s: %(name)s:\n%(message)s")
ch.setFormatter(formatter)
logger.handlers = []
logger.addHandler(ch)
logger = logging.getLogger("ghpythonremote.GH_to_python")

ROOT = path.abspath(path.dirname(inspect.getfile(ghpythonremote)))
rpyc_server_py = path.join(ROOT, "pythonservice.py")

# Set connection to CLOSED if this is the first run
# and initialize set of linked modules
try:
    remote_python_status
except NameError:
    remote_python_status = "CLOSED"
    lkd_modules = set()

# Wait for connection to connect or terminate
timer = 0
while remote_python_status == "CONNECTING" or remote_python_status == "CLOSING":
    sleep(1)
    timer += 1
    if timer == 10:
        try:
            gh2py_manager.__exit__(*sys.exc_info())
        except Exception:
            pass
        remote_python_status = "CLOSED"
        lkd_modules = set()
        raise RuntimeError(
            "Connection left in an inconsistent state and not returning. Reset "
            "everything."
        )

if run:
    if not remote_python_status == "OPEN":
        remote_python_status = "CONNECTING"
        gh2py_manager = GrasshopperToPythonRemote(
            rpyc_server_py,
            location=location,
            timeout=10,
            port=None,
            log_level=log_level,
            working_dir=working_dir,
        )
        gh2py = gh2py_manager.__enter__()
        remote_python_status = "OPEN"

    # Stuff that we can reach
    rpymod = gh2py.py_remote_modules  # A getter function for a named python module
    rpy = gh2py.connection  # Represents the remote instance root object
    scriptcontext.sticky["rpy"] = rpy
    # Add modules
    for mod in modules:
        try:
            scriptcontext.sticky[mod] = rpymod(mod)
            lkd_modules.add(mod)
        except ImportError:
            gh2py_manager.__exit__(*sys.exc_info())
            raise

elif not remote_python_status == "CLOSED":
    remote_python_status = "CLOSING"
    # Remove linked modules
    for mod in lkd_modules:
        del scriptcontext.sticky[mod]
    del scriptcontext.sticky["rpy"]
    gh2py_manager.__exit__(*sys.exc_info())
    lkd_modules = set()
    remote_python_status = "CLOSED"

# Change variable name because ghpython resets outputs to None before each run
linked_modules = lkd_modules

logger.info("GH to python connection is {}".format(remote_python_status))
# ---------- end ghpythonremote ----------
out = ClusterOutput(ghpythonremote.out)  # Console output.
linked_modules = ClusterOutput(ghpythonremote.linked_modules)  # Names of modules that were successfully added to the scriptcontext.sticky dictionary.
rpy = ClusterOutput(ghpythonremote.rpy)  # The object representing the remote python instance
python_2 = PythonScript(module_names=ghpythonremote.linked_modules)  # -> import_statements; inputs module_names: list
# ---------- python_2: Python ----------
import_statements = ["import scriptcontext as sc"]
for module_name in module_names:
    import_statements.append("{0} = sc.sticky['{0}']".format(module_name))

if len(module_names) == 0:
    import_statements = []
# ---------- end python_2 ----------
import_statements = ClusterOutput(python_2)  # Useful import statements to use the imported modules in your scripts.
