# Grasshopper definition Gravity.gh (Grasshopper 1.0.7)
# plug-ins: Telepathy, Heteroptera, Pufferfish, MeshEdit Components

# vector
vector_waterflow = GetPoint(AtLeast=1, AtMost=1, Realtime=False, TreeAccess=False)
# number
width_crest = GetNumber(AtLeast=1, AtMost=1, Maximum=1.797693135e+308, Minimum=-1.797693135e+308, TreeAccess=False)
# number
ds_ratio = GetNumber(AtLeast=1, AtMost=1, Maximum=1.797693135e+308, Minimum=-1.797693135e+308, TreeAccess=False)
# surface
brep_terrain = GetGeometry(AtLeast=1, AtMost=1, DeleteInput=False, Filter=1073741848, TreeAccess=False)
# line
chord_dam = GetLine(AtLeast=1, AtMost=1, Realtime=False, TreeAccess=False)

# ----
# GRAVITY DAM
# Top
# Concrete dam settings
# Final volume
midpt = CurveMiddle(Curve=chord_dam)
project = Project(Curve=chord_dam, Brep=brep_terrain, Direction=Vector(0, 0, 1))
end = EndPoints(Curve=chord_dam)  # -> Start, End
x_tremez = Extremes(Curve=project, Plane=PlaneXY(0, 0, 0))  # -> Highest, Lowest
pdecon = Deconstruct(Point=x_tremez.Lowest)  # -> XComponent, YComponent, ZComponent
pdecon_2 = Deconstruct(Point=midpt)  # -> XComponent, YComponent, ZComponent
subtraction = Subtraction(A=pdecon_2.ZComponent, B=pdecon.ZComponent)
multiplication = Multiplication(A=subtraction, B=1.5)
line = LineSDL(Start=end.Start, Direction="{0,0,-1}", Length=multiplication)
atan = ArcTangent(Value=ds_ratio)
rotax = RotateAxis(Geometry=line, Angle=atan, Axis=chord_dam)  # -> Geometry, Transform
swp1 = Sweep1(Rail=chord_dam, Sections=line, Miter=1)  # -> flatten(Brep)
swp1_2 = Sweep1(Rail=chord_dam, Sections=rotax.Geometry, Miter=1)  # -> flatten(Brep)
entwine = Entwine(Branch00=swp1, Branch01=swp1_2, FlattenInputs=True)  # -> simplify(Result)
bbx = BrepBrep(BrepA=entwine, BrepB=brep_terrain)  # -> Curves, Points
geo = Geometry(bbx.Curves)
explode = Explode(Curve=geo, Recursive=False)  # -> Segments, Vertices
pline = PolyLine(Vertices=explode.Vertices, Closed=False)
lng = ListLength(List=explode.Vertices)
smoothpline = SmoothPolyline(Polyline=pline, Strength=Slider(0.5, range=0..1), Times=lng)
srfsplit = SurfaceSplit(Surface=entwine, Curves=smoothpline)
center = Center(Geometric=srfsplit, referenceAll=2)  # -> Center, Dimension
sort = SortList(Keys=center.Dimension, ValuesA=srfsplit)  # -> Keys, ValuesA
amp = Amplitude(Vector=vector_waterflow, Amplitude=width_crest)
pt = Point(midpt)
item = ListItem(List=sort.ValuesA, Index=0, Wrap=True)  # -> simplify(Item)
loft = Loft(
    Curves=flatten(smoothpline),
    Options={Adjust=True, Closed=False, LoftEnds=0, LoftSimp=0, LoftType=5, Rebuild=10, Refit=0.01})
simplify = SimplifyTree(Tree=smoothpline, Front=False)
move = Move(Geometry=pt, Motion=amp)  # -> Geometry, Transform
join = BrepJoin(Breps=flatten([loft, item]))  # -> Breps, Closed
branch = TreeBranch(Tree=simplify, Path="{1}", MaintainPaths=True)
branch_2 = TreeBranch(Tree=item, Path="{1}", MaintainPaths=True)
project_2 = ProjectPoint(Point=move.Geometry, Direction="0,0,-1", Geometry=flatten(branch_2))  # -> Point, Index
pline_2 = PolyLine(Vertices=flatten([pt, move.Geometry, project_2.Point]), Closed=True)
move2pt = MoveToPoint(Geometry=pline_2, PointA=pt, PointB=end.Start)  # -> Moved, Vector, Transform
Z = UnitZ(Factor=Slider(20, range=0..100))
swp1_3 = Sweep1(Rail=chord_dam, Sections=move2pt.Moved, Miter=1)
extr = Extrude(Base=branch, Direction=Z)
split = SplitBrep(Brep=extr, Cutter=swp1_3)
split_2 = SplitBrep(Brep=swp1_3, Cutter=extr)
center_2 = Center(Geometric=split, referenceAll=2)  # -> Center, Dimension
center_3 = Center(Geometric=split_2, referenceAll=2)  # -> Center, Dimension
sort_2 = SortList(Keys=center_2.Dimension, ValuesA=split)  # -> Keys, reverse(ValuesA)
sort_3 = SortList(Keys=center_3.Dimension, ValuesA=split_2)  # -> Keys, reverse(ValuesA)
cull_i = CullIndex(List=sort_2.ValuesA, Indices=0, Wrap=True)
item_2 = ListItem(List=sort_3.ValuesA, Index=0, Wrap=True)
join_2 = BrepJoin(Breps=flatten([cull_i, item_2]))  # -> Breps, Closed
sunion = SolidUnion(Breps=[join.Breps, join_2.Breps])
jagged = SettingsSpeed()
mesh = MeshBrep(Brep=sunion, Settings=jagged)

volume = MeshVolume(Mesh=mesh)  # -> Volume, Centroid
round = Round(Number=volume.Volume)  # -> Nearest, Floor, Ceiling

# ---- group: RH_OUT:Geo
# geometry
geo_2 = Geometry(mesh)

# ---- group: RH_OUT:Volume
num = Number(round.Nearest)

# ----
geo_concretedam = RemoteSender(geo_2)
volume_concretedam = RemoteSender(num)
