# Grasshopper definition export.gh (Grasshopper 1.0.7)
# plug-ins: Heron

input = DataInput(
    Destination="C:\Users\Admin\Documents\Github\EarlyStageDesign\JD\Skripts\ghData\ArchDam_test_to_export.ghdata",
    RelativePath="C:\Users\Admin\Documents\Github\EarlyStageDesign\JD\Skripts\ghData\ArchDam_test_to_export.ghdata|ArchDam_test_to_export.ghdata",
    UpdateDelay=50000)  # -> A, B, C, D, E
input_2 = DataInput(
    Destination="C:\Users\Admin\Documents\Github\EarlyStageDesign\JD\Skripts\ghData\Water_test_to_export.ghdata",
    RelativePath="C:\Users\Admin\Documents\Github\EarlyStageDesign\JD\Skripts\ghData\Water_test_to_export.ghdata|Water_test_to_export.ghdata",
    UpdateDelay=50000)  # -> A, B, C, D, E
input_3 = DataInput(
    Destination="C:\Users\Admin\Documents\Github\EarlyStageDesign\JD\Skripts\ghData\DamAxis.ghdata",
    RelativePath="C:\Users\Admin\Documents\Github\EarlyStageDesign\JD\Skripts\ghData\DamAxis.ghdata|DamAxis.ghdata",
    UpdateDelay=50000)  # -> D, E, A, C, B
save = Button()
panel = Panel(input.A)
panel_2 = Panel(input_2.A)
panel_3 = Panel(input_2.B)
srs = SetSpatialReferenceSystem(SRS="EPSG:2056")
crv = Curve(input_3.A)
panel_4 = Panel(input.B)
panel_5 = Panel(input_3.E)
exportvector = ExportVector(
    VectorDataFilename=input.A,
    VectorDataFolder=input.B,
    Fields=input.C,
    Values=input.D,
    FeatureGeometry=input.E,
    Export=save,
    DriverExtension=".shp",
    DriverType="ESRI Shapefile")
exportvector_2 = ExportVector(
    VectorDataFilename=input_2.A,
    VectorDataFolder=input_2.B,
    Fields=input_2.C,
    Values=input_2.D,
    FeatureGeometry=input_2.E,
    Export=save,
    DriverExtension=".shp",
    DriverType="ESRI Shapefile")
exportvector_3 = ExportVector(
    VectorDataFilename=input_3.D,
    VectorDataFolder=input_3.E,
    Fields=input_3.C,
    Values=input_3.B,
    FeatureGeometry=crv,
    Export=save,
    DriverExtension=".shp",
    DriverType="ESRI Shapefile")
panel_6 = Panel(input_3.D)
panel_7 = Panel(exportvector)
panel_8 = Panel(exportvector_3)
panel_9 = Panel(exportvector_2)
